vi "Function_2.gvi"   [LabVIEW NXG 5.0.0]
panel controls:
  "input string": string
  "search string": string = "Blue Motor Position (mm):"
panel indicators:
  "offset past replacement": i32
  "number of replacements": i32
  "substring": string
diagram:
  Search And Replace String(input string=$"input string", search string=$"search string") -> (number of replacements=w1, offset past replacement=w2)
  $"number of replacements" <- w1
  $"offset past replacement" <- w2
  String Length(string=$"search string") -> (length=w3)
  Add(w2, w3) -> w4
  String Subset(length (rest)=8, offset (0)=w4, string=$"input string") -> w5
  $substring <- w5
