vi "Initialize app subroutine.gvi"   [LabVIEW NXG 5.0.0]
inputs:
  "Error In": error
  "Initialize App Bundle Cluster In": "Initialize App Bundle Cluster.gtype"
  "Debugging Cluster In": "Debugging Cluster.gtype"
outputs:
  "Error Out": error
  "Initialize App Bundle Cluster Out": "Initialize App Bundle Cluster.gtype"
  "Debugging Cluster Out": "Debugging Cluster.gtype"
types:
  "All Paths Cluster.gtype" = cluster{"Thorlabs Motor Serial Number File Path": path}
  "Instrument Coms Info.gtype" = cluster{"Arduino Coms Info": "Arduino Detection cluster control.gtype", "Photodetector Names": string[], "Keythley Address": "VISA Instr", "Photodetector Detected?": bool, "Thorlabs Motors Detected?": bool, "Keithley Detected?": bool, "Thorlabs Motors Serial Number": "Thorlabs Motors Serial Number In.gtype", "Photodetector IVI session": "Ivi IviDefault", "Flame ID": string, "Flame Detected?": bool, "Flame Wrapper ID": u64}
  "Initialize App Bundle Cluster.gtype" = cluster{"All Paths": "All Paths Cluster.gtype", "Instrument Coms Info": "Instrument Coms Info.gtype"}
  "Insturment Debugging Cluster.gtype" = cluster{"Keithley": bool, "Arduinos": bool, "Thorlabs Motors": bool, "Photodetector": bool, "Flame Spectr": bool}
  "Debugging Cluster.gtype" = cluster{"Debugging mode?": bool, "Initialize App": bool, "Insturment Debugging": "Insturment Debugging Cluster.gtype"}
uses:
  Rainbow Measurement Setup::Main Functions::Instruction Queue::Current State::FGV Current State.gvi
  Rainbow Measurement Setup::Main Functions::Initialize App::Instruction Extractor Initialize.gvi
  Rainbow Measurement Setup::Side Functions::Instrument Control::Thorlabs Motors::Detection::Thorlabs Serial Number Check.gvi
  Rainbow Measurement Setup::Side Functions::Global Abort::FGV Global Abort.gvi
  Rainbow Measurement Setup::Side Functions::Instrument Control::Arduino::XZ Stage Arduino::XZ Stage Homed FGV.gvi
  Rainbow Measurement Setup::Side Functions::Instrument Control::Thorlabs Motors::Dividing Wavelength Control::Dividing Wavelength Calibration Data FGV.gvi
  Rainbow Measurement Setup::Side Functions::Utilities::Progress Handling::Progress FGV.gvi
  Rainbow Measurement Setup::Main Functions::Rainbow Measurement::Light Power Calibration::Light Calibration Live Parameters FGV.gvi
  Rainbow Measurement Setup::Side Functions::Sample Naming::Sample Prefix FGV.gvi
  Rainbow Measurement Setup::Side Functions::Instrument Control::Debug Cluster Instrument Extractor.gvi
  Rainbow Measurement Setup::Side Functions::Instrument Control::Instrument Detector.gvi
diagram:
  Property Node(instance in=$"Debugging Cluster In") -> ("Debugging mode?"=w1, "Initialize App"=w2, instance out=w3)
  Logical And(w1, not w2) -> w4
  # This is the Initialization Subroutine, its main job is to reset the values of controls, reset functional global variables, scan for instruments
  # and read configuration files among other things.
  case (w4) {
    frame True {
      w5 = $"Error In"
      w6 = $"Initialize App Bundle Cluster In"
      w7 = w3
    }
    frame False {
      case ($"Error In") {
        frame Error, Default {
          w5 = $"Error In"
          w6 = $"Initialize App Bundle Cluster In"
          w7 = w3
        }
        frame No Error {
          call "FGV Current State.gvi"(Current State Instructions="Set Current State", Current State="Initialize App", Error In=$"Error In") -> (Error Out=w8)
          call "Instruction Extractor Initialize.gvi"(Initialize app subroutine states="Reset Disabled/Enabled Controls", Error In=w8) -> (Initialize app States array=w9, SubStates Output Array=w10, Error Out=w11)
          s1 = w11  # shift register
          s2 = $"Initialize App Bundle Cluster In"  # shift register
          s3 = w3  # shift register
          for {
            w12 = each element of w9
            w13 = each element of w10
            call "FGV Current State.gvi"(Current State Instructions="Set Current Substate", Current Substate=w13, Error In=s1) -> (Error Out=w14)
            case (w12) {
              frame "Read Configuration Files" {
                call "Thorlabs Serial Number Check.gvi"(Initialize App Bundle Cluster In=s2, Error In=w14) -> (Initialize App Bundle Cluster Out=w16, Error Out=w15)
                w17 = s3
              }
              frame "Reset Disabled/Enabled Controls", Default {
                w15 = w14
                w16 = s2
                w17 = s3
              }
              frame "Reset Doubles" {
                w15 = w14
                w16 = s2
                w17 = s3
              }
              frame "Reset Booleans" {
                w15 = w14
                w16 = s2
                w17 = s3
              }
              frame "Reset Strings" {
                w15 = w14
                w16 = s2
                w17 = s3
              }
              frame "Reset Global Variables" {
                call "FGV Global Abort.gvi"(Global Abort Instructions="Reset State", Error In=w14) -> (Error Out=w18)
                call "XZ Stage Homed FGV.gvi"(FGV Instructions="Reset State", Error In=w18) -> (Error Out=w19)
                call "Dividing Wavelength Calibration Data FGV.gvi"(General FGV Instructions="Set State", Error In=w19) -> (Error Out=w20)
                call "Progress FGV.gvi"(FGV Instructions="Reset State", Error In=w20) -> (Error Out=w21)
                call "Light Calibration Live Parameters FGV.gvi"(FGV Instructions="Reset State", Error In=w21) -> (Error Out=w22)
                call "Sample Prefix FGV.gvi"(FGV Instructions="Reset State", Error In=w22) -> (Error Out=w15)
                w16 = s2
                w17 = s3
              }
              frame "Detect Instruments" {
                call "Debug Cluster Instrument Extractor.gvi"(Debugging Cluster In=s3, Error In=w14) -> (Debuging Cluster Out=w17, Instruments to Detect=w23, Error Out=w24)
                s4 = w24  # shift register
                s5 = s2  # shift register
                for {
                  w25 = each element of w23
                  Property Node(instance in=s5) -> ("Instrument Coms Info"=w26, instance out=w27)
                  call "Instrument Detector.gvi"(Instruments To Detect control=w25, Instrument Addresses In=w26, Error In=s4) -> (Instrument Addresses Out=w28, Error Out=w29)
                  Property Node(instance in=w27, "Instrument Coms Info"=w28) -> (instance out=w30)
                  call "FGV Global Abort.gvi"(Global Abort Instructions="Read Current State", Error In=w29) -> (Global Abort Out=w31, Error Out=w32)
                  next s4 = w32
                  next s5 = w30
                  stop if w31
                }
                w15 = s4
                w16 = s5
              }
            }
            call "FGV Global Abort.gvi"(Global Abort Instructions="Read Current State", Error In=w15) -> (Global Abort Out=w33, Error Out=w34)
            next s1 = w34
            next s2 = w16
            next s3 = w17
            stop if w33
          }
          w5 = s1
          w6 = s2
          w7 = s3
        }
      }
    }
  }
  $"Initialize App Bundle Cluster Out" <- w6
  $"Debugging Cluster Out" <- w7
  $"Error Out" <- w5
