vi "Beam Power Density Calibration Subroutine.gvi"   [LabVIEW NXG 5.0.0]
inputs:
  "Error In": error
outputs:
  "Error Out": error
panel controls:
  "Stand Alone Operation": bool
  "Instrument Address Output Cluster": "Instrument Address Output Cluster.gtype"
  "XZ Scan Parameters In": "XZ Scan Parameters.gtype"
panel indicators:
  "Beam Power Density": f64[][]
  "XZ Array": "XZ Coordinate Array.gtype"
types:
  T1 = cluster{"Element 1": "VISA Instr", "Element 2": string}
  "Arduino Detection cluster control.gtype" = cluster{"XZ Stage Arduino Address": "VISA Instr", "XZ Stage Arduino Detected?": bool, "Multiplexer Arduino Detected?": bool, "Multiplexer Arduino Address": "VISA Instr", "Arduinos List": T1[], "XZ Stage Log": string, "Multiplexer Log": string}
  "Thorlabs Motors Serial Number In.gtype" = cluster{"Thorlabs Blue Motor": string, "Thorlabs Red Motor": string}
  "Instrument Address Output Cluster.gtype" = cluster{"Arduino Coms Info": "Arduino Detection cluster control.gtype", "Photodetector Names": string[], "Keythley Address": "VISA Instr", "Photodetector Detected?": bool, "Thorlabs Motors Detected?": bool, "Keithley Detected?": bool, "Thorlabs Motors Serial Number": "Thorlabs Motors Serial Number In.gtype", "Photodetector IVI session": "Ivi IviDefault"}
  "XZ Scan Parameters.gtype" = cluster{"X Scan Range (mm)": f64, "Z Scan Range (mm)": f64, "X Steps": f64, "Z Steps": f64, "Center Coordinate X": f64, "Center Coordinate Z": f64, "Z Step size": f64, "X Step size": f64, "Total Steps": f64, "Z Starting Point": f64, "X Starting Point": f64, "Z End Point": f64, "X End Point": f64}
  "XZ Coordinate Cluster.gtype" = cluster{"X Coordinate (mm)": f64, "Z Coordinate (mm)": f64, "Coordinate Gcode": string, "Beam Power (W)": f64}
  "XZ Coordinate Array.gtype" = "XZ Coordinate Cluster.gtype"[]
uses:
  Rainbow Measurement Setup::Side Functions::Scanning Calculations::Scan Points Generator.gvi
  Rainbow Measurement Setup::Side Functions::Instrument Control::Instrument Detector.gvi
  Rainbow Measurement Setup::Side Functions::Global Abort::FGV Global Abort.gvi
  Rainbow Measurement Setup::Side Functions::Instrument Control::Arduino::XZ Stage Arduino::Low Level::XZ Stage Initialize.gvi
  Rainbow Measurement Setup::Side Functions::Instrument Control::Arduino::XZ Stage Arduino::XZ Stage Home Sequence.gvi
  LabView_NXG_Thorlabs_PM100::Examples::Photodetector initialization Sequence with prompt.gvi
  Rainbow Measurement Setup::Main Functions::One Time Calibrations::Beam Power Density::Scan Subroutine.gvi
  Rainbow Measurement Setup::Main Functions::One Time Calibrations::XZ Array To Intensity Graph.gvi
  LabView_NXG_Thorlabs_PM100::Miscelanous::TLPM Close.gvi
  NI::VISA::Close (Instr).gvi
diagram:
  w1 = $"Stand Alone Operation"
  case ($"Error In") {
    frame Error, Default {
      w2 = $"Error In"
      w3 = default
      w4 = default
    }
    frame No Error {
      s1 = $"Error In"  # shift register
      s2 = $"Instrument Address Output Cluster"  # shift register
      s3 = "Check Scan Area Range"  # shift register
      s4 = uninitialised  # shift register
      s5 = $"XZ Scan Parameters In"  # shift register
      s6 = uninitialised  # shift register
      while {
        case (s3) {
          frame "Check Scan Area Range", Default {
            Select(s=w1, t="Detect Instruments", f="Initialize Instruments") -> w12
            call "Scan Points Generator.gvi"(XZ Scan Parameters In=s5, Error In=s1) -> (XZ Scan Parameters Out=w11, XZ Coordinate Array=w8, All In Range?=w13, Error Out=w5)
            Select(s=w13, t=w12, f="Stop App") -> w7
            w6 = s2
            w9 = default
            w10 = s6
          }
          frame "Detect Instruments" {
            s7 = s1  # shift register
            s8 = s2  # shift register
            for {
              w14 = each element of ["Photodetector", "Arduinos"]
              call "Instrument Detector.gvi"(Instruments To Detect control=w14, Instrument Addresses In=s8, Error In=s7) -> (Instrument Addresses Out=w15, Error Out=w16)
              call "FGV Global Abort.gvi"(Global Abort Instructions="Read Current State", Error In=w16) -> (Global Abort Out=w17, Error Out=w18)
              next s7 = w18
              next s8 = w15
              stop if w17
            }
            w5 = s7
            w6 = s8
            w7 = "Initialize Instruments"
            w8 = s4
            w9 = default
            w10 = s6
            w11 = s5
          }
          frame "Initialize Instruments" {
            Property Node(instance in=s2) -> ("Arduino Coms Info:XZ Stage Arduino Address"=w19, instance out=w20)
            call "XZ Stage Initialize.gvi"(XZ Carriage Arduino Adress In=w19, Error In=s1) -> (XZ Carriage Arduino Visa Session Out=w21, XZ Carriage Arduino Log=w22, Error Out=w23)
            call "XZ Stage Home Sequence.gvi"(XZ Carriage Arduino Open Visa Session In=w21, XZ Carriage Arduino Log In=w22, Error In=w23) -> (XZ Carriage Arduino Log Out=w24, Error Out=w25)
            call "Photodetector initialization Sequence with prompt.gvi"(Error In=w25) -> (Photodetector IVI session=w26, Error Out=w5)
            Property Node(instance in=w20, "Photodetector IVI session"=w26, "Arduino Coms Info:XZ Stage Log"=w24) -> (instance out=w6)
            w7 = "Scan"
            w8 = s4
            w9 = default
            w10 = s6
            w11 = s5
          }
          frame "Scan" {
            call "Scan Subroutine.gvi"(Instrument Address Output Cluster In=s2, XZ Coordinate Array In=s4, Error In=s1) -> (Instrument Address Output Cluster Out=w6, XZ Coordinate Array Out=w8, Error Out=w27)
            call "XZ Array To Intensity Graph.gvi"(XZ Array=w8, XZ Scan Parameters In=s5, Error In=w27, Graph Reference=reference to "Beam Power Density") -> (Beam Power Density=w10, Error Out=w5)
            w7 = "Close Coms"
            w9 = default
            w11 = s5
          }
          frame "Close Coms" {
            Property Node(instance in=s2) -> ("Arduino Coms Info:XZ Stage Arduino Address"=w28, "Photodetector IVI session"=w29, instance out=w6)
            call "TLPM Close.gvi"(IVI session in=w29, error in (no error)=s1) -> (error out=w30)
            call "Close (Instr).gvi"(session in=w28, error in=w30) -> (error out=w5)
            w7 = "Stop App"
            w8 = s4
            w9 = default
            w10 = s6
            w11 = s5
          }
          frame "Stop App" {
            w5 = s1
            w6 = s2
            w7 = "Check Scan Area Range"
            w8 = s4
            w9 = TRUE
            w10 = s6
            w11 = s5
          }
        }
        call "FGV Global Abort.gvi"(Global Abort Instructions="Read Current State", Error In=w5) -> (Local Abort Out=w31, Global Abort Out=w32, Error Out=w33)
        Logical Or(w31, w32, w9) -> w34
        next s1 = w33
        next s2 = w6
        next s3 = w7
        next s4 = w8
        next s5 = w11
        next s6 = w10
        stop if w34
      }
      w2 = s1
      w3 = s4
      w4 = s6
    }
  }
  $"XZ Array" <- w3
  $"Error Out" <- w2
  $"Beam Power Density" <- w4
