vi "Dividing Wavelength Calculator.gvi"   [LabVIEW NXG 5.0.0]
inputs:
  "Error In": error
  "Full MSpot Multispectral Data Array In": "Full MSpot Multispectral Data.gtype"[]
  "Dividing Wavelength Threshold": f64
outputs:
  "Error Out": error
  "Full MSpot Multispectral Data Array Out": "Full MSpot Multispectral Data.gtype"[]
types:
  "MSpot Spectrum Data.gtype" = cluster{"M Spot Spectrum": cluster{"Wavelength": f64[], "Counts": f64[]}, "Blue Motor Position (mm)": f64, "Red Motor Position (mm)": f64, "Dividing Wavelength (nm)": f64}
  "Rainbow Sweep Types.gtype" = enum{"Red Sweep Closing", "Red Sweep Opening", "Blue Sweep Closing", "Blue Sweep Opening"}
  "Full MSpot Multispectral Data.gtype" = cluster{"MSpot Spectrum Data Array": "MSpot Spectrum Data.gtype"[], "Rainbow Sweep Types": "Rainbow Sweep Types.gtype"}
uses:
  Rainbow Measurement Setup::Main Functions::One Time Calibrations::MSpot Spectrum::Dividing Wavelength Calculations::Spectra Operator.gvi
diagram:
  case ($"Error In") {
    frame Error, Default {
      w1 = $"Error In"
      w2 = $"Full MSpot Multispectral Data Array In"
    }
    frame No Error {
      s1 = $"Error In"  # shift register
      for {
        w3 = each element of $"Full MSpot Multispectral Data Array In"
        call "Spectra Operator.gvi"(Full MSpot Multispectral Data=w3, Error In=s1, Spectra Operator control="Divide Spectra") -> (Operated Data=w4, Error Out=w5)
        call "Spectra Operator.gvi"(Full MSpot Multispectral Data=w4, Error In=w5, Spectra Operator control="Erase Peaks") -> (Operated Data=w6, Error Out=w7)
        Property Node(instance in=w6) -> ("MSpot Spectrum Data Array"=w8, instance out=w9)
        for {
          w10 = each element of w8
          Property Node(instance in=w10) -> ("M Spot Spectrum"=w12, instance out=w13)
          Property Node(instance in=w12) -> ("Wavelength"=w14, "Counts"=w15)
          for (iteration -> i1) {
            w16 = each element of w14
            w17 = each element of w15
            Is Less(x=w17, y=$"Dividing Wavelength Threshold") -> w19
            Is Greater(x=i1, y=30) -> w20
            Logical And(w19, w20) -> w21
            w18 = w16 if w21
            stop if w21
          }
          Property Node(instance in=w13, "Dividing Wavelength (nm)"=w18) -> (instance out=w22)
          append w22 to w11
        }
        Property Node(instance in=w9, "MSpot Spectrum Data Array"=w11) -> (instance out=w23)
        append w23 to w2
        next s1 = w7
      }
      w1 = s1
    }
  }
  $"Full MSpot Multispectral Data Array Out" <- w2
  $"Error Out" <- w1
