vi "MSpot Calibration Save Graphs Prompt.gvi"   [LabVIEW NXG 5.0.0]
inputs:
  "M Spot Spectrum Calibration State Machine Instructions": "MSpot Spectrum Calibration State Machine Instructions.gtype" = "Stop App"
  "Error In": error
  "Debugging Cluster In": "Debugging Cluster.gtype"
outputs:
  "Selected State": "MSpot Spectrum Calibration State Machine Instructions.gtype"
  "Error Out": error
  "Debugging Cluster In Out": "Debugging Cluster.gtype"
types:
  "MSpot Spectrum Calibration State Machine Instructions.gtype" = enum{"Start App", "Detect Instruments", "Initialize Instruments", "Rainbow Sweep", "Close Coms", "Load Calibration", "Check Graphs", "Save Graphs", "Stop App"}
  "Insturment Debugging Cluster.gtype" = cluster{"Keithley": bool, "Arduinos": bool, "Thorlabs Motors": bool, "Photodetector": bool, "Flame Spectr": bool}
  "Debugging Cluster.gtype" = cluster{"Debugging mode?": bool, "Initialize App": bool, "Insturment Debugging": "Insturment Debugging Cluster.gtype"}
diagram:
  # This subVI Prompts the user to save or discard the calibration files in case
  # we are coming from close coms wich means that a new calibration has been
  # performed. Otherwise it does not
  case ($"Error In") {
    frame Error, Default {
      w1 = "Stop App"
      w2 = $"Error In"
      w3 = $"Debugging Cluster In"
    }
    frame No Error {
      case ($"M Spot Spectrum Calibration State Machine Instructions") {
        frame "Load Calibration" {
          w1 = "Stop App"
          w3 = $"Debugging Cluster In"
        }
        frame "Close Coms" {
          w4 = "Do you wish to save the current\ncalibration files?\nThey will be saved on the Extra \ninstallers folder."
          Two Button Dialog(F button name ("Cancel")="Oh, don't bother\nI was just testing.", T button name ("OK")="Yes please save \nthe calibration files :D", message=w4) -> (T Button?=w5)
          Select(s=w5, t="Save Graphs", f="Stop App") -> w1
          w3 = $"Debugging Cluster In"
        }
        frame "Start App", Default {
          Property Node(instance in=$"Debugging Cluster In") -> ("Debugging mode?"=w6, instance out=w3)
          case (w6) {
            frame False, Default {
              w1 = "Stop App"
            }
            frame True {
              w7 = "Do you wish to save the current\ncalibration files?\nThey will be saved on the Extra \ninstallers folder."
              Two Button Dialog(F button name ("Cancel")="Oh, don't bother\nI was just testing.", T button name ("OK")="Yes please save \nthe calibration files :D", message=w7) -> (T Button?=w8)
              Select(s=w8, t="Save Graphs", f="Stop App") -> w1
            }
          }
        }
      }
      w2 = $"Error In"
    }
  }
  $"Error Out" <- w2
  $"Selected State" <- w1
  $"Debugging Cluster In Out" <- w3
