vi "MSpot Spectra file handling.gvi"   [LabVIEW NXG 5.0.0]
inputs:
  "Error In": error
  "Full MSpot Multispectral Data Array In": "Full MSpot Multispectral Data.gtype"[]
  "Modify File Operation": "Modify File Operation.gtype" = "Save TXT"
outputs:
  "Error Out": error
  "Full MSpot Multispectral Data Array Out": "Full MSpot Multispectral Data.gtype"[]
  "Found Any File?": bool
types:
  "MSpot Spectrum Data.gtype" = cluster{"M Spot Spectrum": cluster{"Wavelength": f64[], "Counts": f64[]}, "Blue Motor Position (mm)": f64, "Red Motor Position (mm)": f64, "Dividing Wavelength (nm)": f64}
  "Rainbow Sweep Types.gtype" = enum{"Red Sweep Closing", "Red Sweep Opening", "Blue Sweep Closing", "Blue Sweep Opening"}
  "Full MSpot Multispectral Data.gtype" = cluster{"MSpot Spectrum Data Array": "MSpot Spectrum Data.gtype"[], "Rainbow Sweep Types": "Rainbow Sweep Types.gtype"}
  "Modify File Operation.gtype" = enum{"Save TXT", "Load TXT"}
uses:
  Rainbow Measurement Setup::Main Functions::One Time Calibrations::MSpot Spectrum::Dividing Wavelength Calculations::Spectra Operator.gvi
  Rainbow Measurement Setup::Main Functions::One Time Calibrations::MSpot Spectrum::File Handling::MSpot Folder Scan.gvi
  Rainbow Measurement Setup::Main Functions::One Time Calibrations::MSpot Spectrum::File Handling::Folder Scan Sweep type.gvi
  Rainbow Measurement Setup::Main Functions::One Time Calibrations::MSpot Spectrum::File Handling::File number Sorter.gvi
  Rainbow Measurement Setup::Main Functions::One Time Calibrations::MSpot Spectrum::File Handling::MSpot Data Extractor.gvi
  Rainbow Measurement Setup::Main Functions::One Time Calibrations::MSpot Spectrum::File Handling::MSpot Folder Check.gvi
  Rainbow Measurement Setup::Side Functions::Sample Naming::txt Extension adder.gvi
  Rainbow Measurement Setup::Main Functions::Modify TXT file::Modify Measurement TXT File.gvi
  Rainbow Measurement Setup::Side Functions::Messages And Prompts::FGV Repeat Operation for all following files.gvi
diagram:
  # This subVI Handles the Saving of all the MSpot Spectra Calibration Files
  case ($"Error In") {
    frame Error, Default {
      w1 = $"Error In"
      w2 = $"Full MSpot Multispectral Data Array In"
      w3 = default
    }
    frame No Error {
      case (FALSE) {
        frame False, Default {
          w4 = $"Full MSpot Multispectral Data Array In"
          w5 = $"Error In"
        }
        frame True {
          s1 = $"Error In"  # shift register
          for {
            w6 = each element of $"Full MSpot Multispectral Data Array In"
            call "Spectra Operator.gvi"(Full MSpot Multispectral Data=w6, Error In=s1, Spectra Operator control="Divide Spectra") -> (Operated Data=w7, Error Out=w8)
            call "Spectra Operator.gvi"(Full MSpot Multispectral Data=w7, Error In=w8, Spectra Operator control="Smooth Peaks") -> (Operated Data=w9, Error Out=w10)
            append w9 to w4
            next s1 = w10
          }
          w5 = s1
        }
      }
      case ($"Modify File Operation") {
        frame "Load TXT" {
          call "MSpot Folder Scan.gvi"(Error In=w5) -> (Folder Path=w12, Folder Names=w13, Error Out=w14)
          s2 = w14  # shift register
          s3 = "Full MSpot Multispectral Data.gtype"[] []  # shift register
          s4 = 0  # shift register
          for {
            w15 = each element of w13
            call "Folder Scan Sweep type.gvi"(Folder Name In=w15, Error In=s2) -> (Foldername Out=w17, Sweep Type=w18, Is folder sweep type?=w19, Error Out=w20)
            case (w19) {
              frame False, Default {
                w21 = s4
                w22 = s3
                w23 = w20
                w24 = default
              }
              frame True {
                Increment(x=s4) -> w21
                Array Index(array=s3) -> (out0[s4]=w25)
                Build Path(base path=w12, name or relative path=w17) -> (appended path=w26)
                List Folder(error in=w20, path=w26) -> (error out=w27, file names=w28, path out=w29)
                call "File number Sorter.gvi"(Sweep Type=w18, File Names=w28, Error In=w27) -> (Sorted Files Array=w30, Error Out=w31)
                s5 = w31  # shift register
                s6 = "MSpot Spectrum Data.gtype"[] []  # shift register
                s7 = 0  # shift register
                for {
                  w32 = each element of w30
                  Build Path(base path=w29, name or relative path=w32) -> (appended path=w34)
                  Search And Replace String(input string=w32, search string="MSpot_Spectrum_Calibration") -> (number of replacements=w35)
                  Is Not Equal To 0(x=w35) -> w36
                  call "MSpot Data Extractor.gvi"(Filepath to load=w34, Sub Array Index In=s7, M Spot Spectrum Sub Array In=s6, Modify file operation=$"Modify File Operation", Calibration file?=w36, Error In=s5) -> (Sub Array Index Out=w37, M Spot Spectrum Sub Array Out=w38, File Found?=w39, Error Out=w40)
                  append w39 to w33
                  next s5 = w40
                  next s6 = w38
                  next s7 = w37
                }
                Property Node(instance in=w25, "MSpot Spectrum Data Array"=s6, "Rainbow Sweep Types"=w18) -> (instance out=w41)
                Insert Into Array(inArray=s3, new=w41) -> w22
                Or Array Elements(Boolean array=w33) -> (logical OR=w24)
                w23 = s5
              }
            }
            append w24 to w16
            next s2 = w23
            next s3 = w22
            next s4 = w21
          }
          Or Array Elements(Boolean array=w16) -> (logical OR=w3)
          w11 = s2
          w2 = s3
        }
        frame "Save TXT", Default {
          s8 = w5  # shift register
          for {
            w42 = each element of w4
            Property Node(instance in=w42) -> ("MSpot Spectrum Data Array"=w43, "Rainbow Sweep Types"=w44)
            call "MSpot Folder Check.gvi"(Rainbow Sweep Types=w44, Error In=s8, Create New Folders?=TRUE) -> (Folder Out=w45, Error Out=w46)
            s9 = w46  # shift register
            for {
              w47 = each element of w43
              Property Node(instance in=w47) -> ("M Spot Spectrum"=w48, "Blue Motor Position (mm)"=w49, "Red Motor Position (mm)"=w50)
              Format Into String(w49) -> w51
              Format Into String(w50) -> w52
              Concatenate Strings("Blue Motor Position (mm): ", w51, "\t", "Red Motor Position (mm): ", w52) -> w53
              Format Into String(initString="MSpot_Spectrum_Calibration_Position_", w49) -> w54
              Concatenate Strings(w54, "_") -> w55
              Format Into String(initString=w55, w50) -> w56
              call "txt Extension adder.gvi"(Name without .txt=w56, Error In=s9) -> (Name with .txt=w57, Error Out=w58)
              Property Node(instance in=w48) -> ("Wavelength"=w59, "Counts"=w60)
              Build Array(w59, w60) -> w61
              Transpose 2D Array(2D array=w61) -> (transposed array=w62)
              Build Path(base path=w45, name or relative path=w57) -> (appended path=w63)
              call "Modify Measurement TXT File.gvi"(Filename to load/save=w63, Variable Header Info=w53, Modify File Operation=$"Modify File Operation", Data To Save=w62, Error In=w58, Measurement File Type="Light Calibration Dividing Wavelength Spectrum") -> (Error Out=w64)
              next s9 = w64
            }
            next s8 = s9
          }
          w11 = s8
          w2 = w4
          w3 = default
        }
      }
      call "FGV Repeat Operation for all following files.gvi"(FGV Instructions="Reset State", Error In=w11) -> (Error Out=w1)
    }
  }
  $"Full MSpot Multispectral Data Array Out" <- w2
  $"Found Any File?" <- w3
  $"Error Out" <- w1
