vi "MSpot Spectrum Calibration Subroutine.gvi"   [LabVIEW NXG 5.0.0]
inputs:
  "Error In": error
  "Stand Alone?": bool
  "Calibration Operation Control": "Calibration Operation Control.gtype" = "Check Calibration"
  "Instrument Coms Info In": "Instrument Coms Info.gtype"
  "Rainbow Sweep Param Selector": "Rainbow Sweep Param Selector.gtype" = {0, 1100, 300, 1, 1, 0}
  "MSpot Spectrum Calibration Parameters In": "MSpot Spectrum Calibration Parameters.gtype" = {"Min Position (mm)"=0, "Max Position (mm)"=10, "Position step size (mm)"=0.1, "Manual Spectra?"=FALSE, "Flame Integration Time (us)"=1000, "Flame Scans to Average"=1}
  "Debugging Cluster In": "Debugging Cluster.gtype"
  "Full Beam Multispectral Data Array In": "Full MSpot Multispectral Data.gtype"[]
  "XZ All Position Cluster": "XZ All Position Cluster.gtype" = {0, 0, 188, 30, 39, 70}
outputs:
  "Error Out": error
  "Instrument Coms Info Out": "Instrument Coms Info.gtype"
  "Debugging Cluster Out": "Debugging Cluster.gtype"
  "Full Beam Multispectral Data Array Out": "Full MSpot Multispectral Data.gtype"[]
types:
  T1 = cluster{"Element 1": "VISA Instr", "Element 2": string}
  "Arduino Detection cluster control.gtype" = cluster{"XZ Stage Arduino Address": "VISA Instr", "XZ Stage Arduino Detected?": bool, "Multiplexer Arduino Detected?": bool, "Multiplexer Arduino Address": "VISA Instr", "Arduinos List": T1[], "XZ Stage Log": string, "Multiplexer Log": string}
  "Thorlabs Motors Serial Number In.gtype" = cluster{"Thorlabs Blue Motor": string, "Thorlabs Red Motor": string, "Blue Motor Homed?": bool, "Red Motor Homed?": bool}
  "Instrument Coms Info.gtype" = cluster{"Arduino Coms Info": "Arduino Detection cluster control.gtype", "Photodetector Names": string[], "Keythley Address": "VISA Instr", "Photodetector Detected?": bool, "Thorlabs Motors Detected?": bool, "Keithley Detected?": bool, "Thorlabs Motors Serial Number": "Thorlabs Motors Serial Number In.gtype", "Photodetector IVI session": "Ivi IviDefault", "Flame ID": string, "Flame Detected?": bool, "Flame Wrapper ID": u64}
  "Raibow Sweep Selector.gtype" = enum{"Red Sweep", "Blue Sweep", "Full Sweep Red First", "Full Sweep Blue First"}
  T2 = enum{"Red Sweep Closing", "Red Sweep Opening", "Red Sweep Both Ways"}
  T3 = enum{"Blue Sweep Opening", "Blue Sweep Closing", "Blue Sweep Both Ways"}
  "Rainbow Sweep Type Selector.gtype" = cluster{"Red Sweep Mode": T2, "Blue Sweep Mode": T3}
  "Rainbow Sweep Param Selector.gtype" = cluster{"Raibow Sweep Selector": "Raibow Sweep Selector.gtype", "Max Wavelength (nm)": f64, "Min Wavelength (nm)": f64, "Wavelength Step (nm)": f64, "Rainbow Sweep Type Selector": "Rainbow Sweep Type Selector.gtype"}
  "MSpot Spectrum Data.gtype" = cluster{"M Spot Spectrum": cluster{"Wavelength": f64[], "Counts": f64[]}, "Blue Motor Position (mm)": f64, "Red Motor Position (mm)": f64, "Dividing Wavelength (nm)": f64}
  "Rainbow Sweep Types.gtype" = enum{"Red Sweep Closing", "Red Sweep Opening", "Blue Sweep Closing", "Blue Sweep Opening"}
  "Full MSpot Multispectral Data.gtype" = cluster{"MSpot Spectrum Data Array": "MSpot Spectrum Data.gtype"[], "Rainbow Sweep Types": "Rainbow Sweep Types.gtype"}
  "Insturment Debugging Cluster.gtype" = cluster{"Keithley": bool, "Arduinos": bool, "Thorlabs Motors": bool, "Photodetector": bool, "Flame Spectr": bool}
  "Debugging Cluster.gtype" = cluster{"Debugging mode?": bool, "Initialize App": bool, "Insturment Debugging": "Insturment Debugging Cluster.gtype"}
  "Calibration Operation Control.gtype" = enum{"Check Calibration", "Load Calibration", "New Calibration"}
  "MSpot Spectrum Calibration Parameters.gtype" = cluster{"Min Position (mm)": f64, "Max Position (mm)": f64, "Position step size (mm)": f64, "Manual Spectra?": bool, "Flame Integration Time (us)": f64, "Flame Scans to Average": u32}
  T4 = cluster{"X Coordinate (mm)": f64, "Z Coordinate (mm)": f64}
  "XZ All Position Cluster.gtype" = cluster{"Cell R.01 Coordinates": T4, "Diffusor Coordinates": T4, "Photodetector Coordinates": T4}
uses:
  Rainbow Measurement Setup::Main Functions::Instruction Queue::Current State::FGV Current State.gvi
  Rainbow Measurement Setup::Side Functions::Global Abort::FGV Global Abort.gvi
  Rainbow Measurement Setup::Side Functions::Instrument Control::Debug Cluster Instrument Extractor.gvi
  Rainbow Measurement Setup::Main Functions::One Time Calibrations::Beam Power Density::Specific Detect Instruments Subroutine.gvi
  Rainbow Measurement Setup::Side Functions::Instrument Control::Thorlabs Motors::Movement::KCube Move to 0 or Home.gvi
  Rainbow Measurement Setup::Side Functions::Instrument Control::Arduino::XZ Stage Arduino::XZ Stage Initialize And Home.gvi
  Rainbow Measurement Setup::Side Functions::Instrument Control::Arduino::XZ Stage Arduino::XZ Stage Move to Position.gvi
  Rainbow Measurement Setup::Side Functions::Instrument Control::Flame Spectrometer::Flame Initialize.gvi
  Rainbow Measurement Setup::Main Functions::One Time Calibrations::MSpot Spectrum::MSpot Spectrum Rainbow Sweep Subroutine.gvi
  Rainbow Measurement Setup::Side Functions::Instrument Control::Arduino::XZ Stage Arduino::XZ Stage Close Coms.gvi
  Rainbow Measurement Setup::Side Functions::Instrument Control::Flame Spectrometer::Flame Close.gvi
  Rainbow Measurement Setup::Main Functions::One Time Calibrations::MSpot Spectrum::File Handling::MSpot Spectra file handling.gvi
  Rainbow Measurement Setup::Main Functions::One Time Calibrations::MSpot Spectrum::File Handling::MSpot Load Prompt.gvi
  Rainbow Measurement Setup::Main Functions::One Time Calibrations::MSpot Spectrum::MSpot Spectrum Visualizer.gvi
  Rainbow Measurement Setup::Main Functions::One Time Calibrations::MSpot Spectrum::File Handling::MSpot Calibration Save Graphs Prompt.gvi
  Rainbow Measurement Setup::Side Functions::Instrument Control::Thorlabs Motors::Dividing Wavelength Control::Dividing Wavelength Calibration Data FGV.gvi
diagram:
  # This subVI takes a full spectrum for each guillotine motor position and then changes the guillotine position and continues on taking spectra.
  # After all the spectra have been taken we are presented with the results to determine the dividing wavelength for each position and then we can
  # write down the dividing wavelength file.
  case ($"Error In") {
    frame Error, Default {
      w1 = $"Error In"
      w2 = default
      w3 = $"Instrument Coms Info In"
      w4 = $"Debugging Cluster In"
    }
    frame No Error {
      call "FGV Current State.gvi"(Current State Instructions="Set Current State and Substate", Current State="MSpot Spectrum Calibration", Current Substate="", Error In=$"Error In") -> (Error Out=w5)
      s1 = w5  # shift register
      s2 = "Start App"  # shift register
      s2.prev1 = uninitialised  # shift register
      s3 = $"Instrument Coms Info In"  # shift register
      s4 = $"Full Beam Multispectral Data Array In"  # shift register
      s5 = $"Debugging Cluster In"  # shift register
      while {
        call "FGV Global Abort.gvi"(Global Abort Instructions="Read Current State") -> (Local Abort Out=w6, Global Abort Out=w7)
        Is Not Equal(x=s2, y="Stop App") -> w8
        Logical And(w6, w8) -> w9
        Select(s=w9, t="Close Coms", f=s2) -> w10
        case (w10) {
          frame "Start App", Default {
            call "FGV Current State.gvi"(Current State Instructions="Set Current Substate", Current Substate="Starting MSpot Calibration", Error In=s1) -> (Error Out=w12)
            Select(s=$"Stand Alone?", t="Detect Instruments", f="Initialize Instruments") -> w17
            Is Equal(x="Check Calibration", y=$"Calibration Operation Control") -> w18
            Select(s=w18, t="Check Graphs", f="Load Calibration") -> w19
            Is Equal(x="Load Calibration", y=$"Calibration Operation Control") -> w20
            Logical Or(w18, w20) -> w21
            Select(s=w21, t=w19, f=w17) -> w11
            w13 = s3
            w14 = s4
            w15 = default
            w16 = s5
          }
          frame "Detect Instruments" {
            call "FGV Current State.gvi"(Current State Instructions="Set Current Substate", Current Substate="Detecting Instruments", Error In=s1) -> (Error Out=w22)
            call "Debug Cluster Instrument Extractor.gvi"(Debugging Cluster In=s5, Error In=w22) -> (Debuging Cluster Out=w16, Instruments to Detect=w23, Error Out=w24)
            call "Specific Detect Instruments Subroutine.gvi"(Instrument Coms Info In=s3, Error In=w24, Instruments To Detect Array=w23, Stand Alone?=$"Stand Alone?") -> (Instrument Coms Info Out=w13, Error Out=w12)
            w11 = "Initialize Instruments"
            w14 = s4
            w15 = default
          }
          frame "Initialize Instruments" {
            Property Node(instance in=$"XZ All Position Cluster") -> ("Diffusor Coordinates"=w25)
            call "FGV Current State.gvi"(Current State Instructions="Set Current Substate", Current Substate="Initializing Instruments", Error In=s1) -> (Error Out=w26)
            call "KCube Move to 0 or Home.gvi"(Instrument Coms Info In=s3, Debugging Cluster In=s5, Error In=w26) -> (Instrument Coms Info Out=w27, Debugging Cluster Out=w28, Error Out=w29)
            call "XZ Stage Initialize And Home.gvi"(Instrument Coms Info In=w27, Debugging Cluster In=w28, Error In=w29) -> (Instrument Coms Info Out=w30, Debugging Cluster Out=w31, Error Out=w32)
            call "XZ Stage Move to Position.gvi"(Instrument Coms Info In=w30, Debugging Cluster In=w31, Error In=w32, XZ Coordinate Cluster In=w25) -> (Instrument Coms Info Out=w33, Debugging Cluster Out=w34, Error Out=w35)
            call "Flame Initialize.gvi"(Instrument Coms Info In=w33, Debugging Cluster In=w34, Error In=w35) -> (Instrument Coms Info Out=w13, Debugging Cluster Out=w16, Error Out=w12)
            w11 = "Rainbow Sweep"
            w14 = s4
            w15 = default
          }
          frame "Rainbow Sweep" {
            $"Full Beam Multispectral Data Array Out" <- "Full MSpot Multispectral Data.gtype"[] []
            call "FGV Current State.gvi"(Current State Instructions="Set Current Substate", Current Substate="Acquiring Spectra", Error In=s1) -> (Error Out=w36)
            call "MSpot Spectrum Rainbow Sweep Subroutine.gvi"(Instrument Coms Info In=s3, MSpot Spectrum Calibration Parameters In=$"MSpot Spectrum Calibration Parameters In", Rainbow Sweep Param Selector=$"Rainbow Sweep Param Selector", Debugging Cluster In=s5, Error In=w36) -> (Instrument Coms Info Out=w13, Full MSpot Multispectral Data Array=w14, Debugging Cluster Out=w16, Error Out=w12)
            w11 = "Close Coms"
            w15 = default
          }
          frame "Close Coms" {
            call "FGV Current State.gvi"(Current State Instructions="Set Current Substate", Current Substate="Closing Coms", Error In=s1) -> (Error Out=w37)
            call "XZ Stage Close Coms.gvi"(Instrument Coms Info In=s3, Error In=w37) -> (Instrument Coms Info Out=w38, Error Out=w39)
            call "Flame Close.gvi"(Instrument Coms Info In=w38, Debugging Cluster In=s5, Error In=w39) -> (Instrument Coms Info Out=w13, Debugging Cluster Out=w16, Error Out=w12)
            Select(s=w6, t="Stop App", f="Check Graphs") -> w11
            w14 = s4
            w15 = default
          }
          frame "Load Calibration" {
            call "FGV Current State.gvi"(Current State Instructions="Set Current Substate", Current Substate="Loading Calibration", Error In=s1) -> (Error Out=w40)
            call "MSpot Spectra file handling.gvi"(Full MSpot Multispectral Data Array In=s4, Modify File Operation="Load TXT", Error In=w40) -> (Full MSpot Multispectral Data Array Out=w14, Found Any File?=w41, Error Out=w42)
            call "MSpot Load Prompt.gvi"(Found Any File?=w41, Stand Alone=$"Stand Alone?", Error In=w42) -> (Desired State=w11, Error Out=w12)
            w13 = s3
            w15 = default
            w16 = s5
          }
          frame "Check Graphs" {
            call "FGV Current State.gvi"(Current State Instructions="Set Current Substate", Current Substate="Checking Graphs", Error In=s1) -> (Error Out=w43)
            call "MSpot Spectrum Visualizer.gvi"(Full MSpot Multispectral Data Array=s4, Error In=w43) -> (Error Out=w44)
            call "MSpot Calibration Save Graphs Prompt.gvi"(M Spot Spectrum Calibration State Machine Instructions=s2.prev1, Debugging Cluster In=s5, Error In=w44) -> (Selected State=w11, Debugging Cluster In Out=w16, Error Out=w12)
            w13 = s3
            w14 = s4
            w15 = default
          }
          frame "Save Graphs" {
            call "FGV Current State.gvi"(Current State Instructions="Set Current Substate", Current Substate="Saving Graphs", Error In=s1) -> (Error Out=w45)
            call "MSpot Spectra file handling.gvi"(Full MSpot Multispectral Data Array In=s4, Modify File Operation="Save TXT", Error In=w45) -> (Full MSpot Multispectral Data Array Out=w14, Error Out=w12)
            w11 = "Save Dividing Wavelength"
            w13 = s3
            w15 = default
            w16 = s5
          }
          frame "Save Dividing Wavelength" {
            call "Dividing Wavelength Calibration Data FGV.gvi"(Div Wavelength FGV Instructions="File Save Data", Error In=s1) -> (Error Out=w12)
            w11 = "Stop App"
            w13 = s3
            w14 = s4
            w15 = default
            w16 = s5
          }
          frame "Stop App" {
            call "FGV Current State.gvi"(Current State Instructions="Set Current Substate", Current Substate="Finishing MSpot Calibration", Error In=s1) -> (Error Out=w12)
            w11 = "Start App"
            w13 = s3
            w14 = s4
            w15 = TRUE
            w16 = s5
          }
        }
        Logical Or(w7, w15) -> w46
        next s1 = w12
        next s2 = w11
        next s3 = w13
        next s4 = w14
        next s5 = w16
        stop if w46
      }
      w1 = s1
      w2 = s4
      w3 = s3
      w4 = s5
    }
  }
  $"Debugging Cluster Out" <- w4
  $"Error Out" <- w1
  $"Full Beam Multispectral Data Array Out" <- w2
  $"Instrument Coms Info Out" <- w3
