vi "MSpot Spectrum Rainbow Sweep Subroutine.gvi"   [LabVIEW NXG 5.0.0]
inputs:
  "Instrument Coms Info In": "Instrument Coms Info.gtype"
  "MSpot Spectrum Calibration Parameters In": "MSpot Spectrum Calibration Parameters.gtype" = {"Min Position (mm)"=0, "Max Position (mm)"=10, "Position step size (mm)"=0.1, "Manual Spectra?"=FALSE, "Flame Integration Time (us)"=1000}
  "Rainbow Sweep Param Selector": "Rainbow Sweep Param Selector.gtype" = {0, 1100, 300, 1, 1, 0}
  "Error In": error
  "Debugging Cluster In": "Debugging Cluster.gtype"
outputs:
  "Instrument Coms Info Out": "Instrument Coms Info.gtype"
  "Full MSpot Multispectral Data Array": "Full MSpot Multispectral Data.gtype"[]
  "Debugging Cluster Out": "Debugging Cluster.gtype"
  "Error Out": error
types:
  "Raibow Sweep Selector.gtype" = enum{"Red Sweep", "Blue Sweep", "Full Sweep Red First", "Full Sweep Blue First"}
  "Rainbow Sweep Type Selector.gtype" = cluster{"Red Sweep Mode": enum{"Red Sweep Closing", "Red Sweep Opening"}, "Blue Sweep Mode": enum{"Blue Sweep Opening", "Blue Sweep Closing"}}
  "Rainbow Sweep Param Selector.gtype" = cluster{"Raibow Sweep Selector": "Raibow Sweep Selector.gtype", "Max Wavelength (nm)": f64, "Min Wavelength (nm)": f64, "Wavelength Step (nm)": f64, "Rainbow Sweep Types": "Rainbow Sweep Type Selector.gtype"}
  "MSpot Spectrum Data.gtype" = cluster{"M Spot Spectrum": cluster{"Wavelength": f64[], "Counts": f64[]}, "Blue Motor Position (mm)": f64, "Red Motor Position (mm)": f64}
  "Rainbow Sweep Types.gtype" = enum{"Red Sweep Closing", "Red Sweep Opening", "Blue Sweep Closing", "Blue Sweep Opening"}
  "Full MSpot Multispectral Data.gtype" = cluster{"MSpot Spectrum Data Array": "MSpot Spectrum Data.gtype"[], "Rainbow Sweep Types": "Rainbow Sweep Types.gtype"}
  T1 = cluster{"Element 1": "VISA Instr", "Element 2": string}
  "Arduino Detection cluster control.gtype" = cluster{"XZ Stage Arduino Address": "VISA Instr", "XZ Stage Arduino Detected?": bool, "Multiplexer Arduino Detected?": bool, "Multiplexer Arduino Address": "VISA Instr", "Arduinos List": T1[], "XZ Stage Log": string, "Multiplexer Log": string}
  "Thorlabs Motors Serial Number In.gtype" = cluster{"Thorlabs Blue Motor": string, "Thorlabs Red Motor": string, "Blue Motor Homed?": bool, "Red Motor Homed?": bool}
  "Instrument Coms Info.gtype" = cluster{"Arduino Coms Info": "Arduino Detection cluster control.gtype", "Photodetector Names": string[], "Keythley Address": "VISA Instr", "Photodetector Detected?": bool, "Thorlabs Motors Detected?": bool, "Keithley Detected?": bool, "Thorlabs Motors Serial Number": "Thorlabs Motors Serial Number In.gtype", "Photodetector IVI session": "Ivi IviDefault", "Flame ID": string, "Flame Detected?": bool, "Flame Wrapper ID": u64}
  "Insturment Debugging Cluster.gtype" = cluster{"Keithley": bool, "Arduinos": bool, "Thorlabs Motors": bool, "Photodetector": bool, "Flame Spectr": bool}
  "Debugging Cluster.gtype" = cluster{"Debugging mode?": bool, "Initialize App": bool, "Insturment Debugging": "Insturment Debugging Cluster.gtype"}
  "MSpot Spectrum Calibration Parameters.gtype" = cluster{"Min Position (mm)": f64, "Max Position (mm)": f64, "Position step size (mm)": f64, "Manual Spectra?": bool, "Flame Integration Time (us)": f64}
uses:
  Rainbow Measurement Setup::Side Functions::Rainbow Sweep::Rainbow Sweep Type Extractor.gvi
  Rainbow Measurement Setup::Main Functions::One Time Calibrations::MSpot Spectrum::MSpot Step Calculator.gvi
  Rainbow Measurement Setup::Side Functions::Instrument Control::Thorlabs Motors::Movement::KCube Initialize and Home.gvi
  Rainbow Measurement Setup::Side Functions::Instrument Control::Thorlabs Motors::Movement::KCube Motor Single Move to Position.gvi
  Rainbow Measurement Setup::Side Functions::Instrument Control::Flame Spectrometer::Flame Get Spectra.gvi
  Rainbow Measurement Setup::Side Functions::Instrument Control::Thorlabs Motors::Movement::KCube Motors Close.gvi
  Rainbow Measurement Setup::Main Functions::One Time Calibrations::MSpot Spectrum::Random Data Generator.gvi
diagram:
  # This SubVI Performs a scan of the spectrum of the beam (STILL FLAME CONNECTION MISSING) and then moves the blade motors to perform a full scan of the spectrum with respect to position.
  case ($"Error In") {
    frame Error, Default {
      w1 = default
      w2 = $"Error In"
      w3 = $"Instrument Coms Info In"
      w4 = $"Debugging Cluster In"
    }
    frame No Error {
      call "Rainbow Sweep Type Extractor.gvi"(Rainbow Sweep Parameters=$"Rainbow Sweep Param Selector", Error In=$"Error In") -> (Rainbow Sweep Array=w5, Error Out=w6)
      call "MSpot Step Calculator.gvi"(MSpot Spectrum Calibration Parameters In=$"MSpot Spectrum Calibration Parameters In") -> (Manual Spectra?=w7, Number of steps=w8)
      s1 = "Full MSpot Multispectral Data.gtype"[] []  # shift register
      s2 = w6  # shift register
      s3 = $"Instrument Coms Info In"  # shift register
      s4 = $"Debugging Cluster In"  # shift register
      for (iteration -> i1) {
        w9 = each element of w5
        Array Index(array=s1) -> (out0[i1]=w10)
        case (w9) {
          frame "Red Sweep Opening", Default {
            call "KCube Initialize and Home.gvi"(Instrument Coms Info In=s3, Debugging Cluster In=s4, Error In=s2, KCube Motor Selector="Blue Motor") -> (Instrument Coms Info Out=w15, Debugging Cluster Out=w16, Error Out=w17)
            s5 = w17  # shift register
            s6 = "MSpot Spectrum Data.gtype"[] []  # shift register
            s7 = w15  # shift register
            s8 = w16  # shift register
            for (N = w8) (iteration -> i2) {
              Property Node(instance in=$"MSpot Spectrum Calibration Parameters In") -> ("Max Position (mm)"=w18, "Position step size (mm)"=w19)
              To Double Precision Float(number=i2) -> w20
              Multiply(w19, w20) -> w21
              Subtract(x=w18, y=w21) -> w22
              call "KCube Motor Single Move to Position.gvi"(Instrument Coms Info In=s7, Debugging Cluster In=s8, Motor Position to move to (mm)=w22, Error In=s5, KCube Motor Selector="Blue Motor") -> (Instrument Coms Info Out=w23, Debugging Cluster Out=w24, Error Out=w25)
              case (w7) {
                frame False, Default {
                  call "Flame Get Spectra.gvi"(Instrument Coms Info In=w23, Debugging Cluster In=w24, Error In=w25) -> (Instrument Coms Info Out=w29, Debugging Cluster Out=w27, Beam Spectrum=w26, Error Out=w28)
                }
                frame True {
                  Wait Until Next Multiple(multiple to wait=300)
                  w30 = cluster{"Wavelength": f64[], "Counts": f64[]} {all zero or empty}
                  w31 = "Please Save the spectrum file\non the oceanview software\nbefore continuing."
                  One Button Dialog(button name ("OK")="Okay, I will", message=w31)
                  w26 = w30
                  w27 = w24
                  w28 = w25
                  w29 = w23
                }
              }
              Property Node(instance in="MSpot Spectrum Data.gtype" {all zero or empty}, "M Spot Spectrum"=w26, "Blue Motor Position (mm)"=w22, "Red Motor Position (mm)"=0) -> (instance out=w32)
              Insert Into Array(inArray=s6, index0=i2, new=w32) -> w33
              next s5 = w28
              next s6 = w33
              next s7 = w29
              next s8 = w27
            }
            call "KCube Motors Close.gvi"(Instrument Coms Info In=s7, Error In=s5) -> (Instrument Coms Info Out=w11, Error Out=w12)
            Property Node(instance in=w10, "Rainbow Sweep Types"=w9, "MSpot Spectrum Data Array"=s6) -> (instance out=w13)
            w14 = s8
          }
          frame "Red Sweep Closing" {
            call "KCube Initialize and Home.gvi"(Instrument Coms Info In=s3, Debugging Cluster In=s4, Error In=s2, KCube Motor Selector="Blue Motor") -> (Instrument Coms Info Out=w34, Debugging Cluster Out=w35, Error Out=w36)
            s9 = w36  # shift register
            s10 = "MSpot Spectrum Data.gtype"[] []  # shift register
            s11 = w34  # shift register
            s12 = w35  # shift register
            for (N = w8) (iteration -> i3) {
              Property Node(instance in=$"MSpot Spectrum Calibration Parameters In") -> ("Min Position (mm)"=w37, "Position step size (mm)"=w38)
              To Double Precision Float(number=i3) -> w39
              Multiply(w38, w39) -> w40
              Add(w37, w40) -> w41
              call "KCube Motor Single Move to Position.gvi"(Instrument Coms Info In=s11, Debugging Cluster In=s12, Motor Position to move to (mm)=w41, Error In=s9, KCube Motor Selector="Blue Motor") -> (Instrument Coms Info Out=w42, Debugging Cluster Out=w43, Error Out=w44)
              call "Random Data Generator.gvi"() -> (Beam Spectrum=w45)
              Property Node(instance in="MSpot Spectrum Data.gtype" {all zero or empty}, "M Spot Spectrum"=w45, "Blue Motor Position (mm)"=w41, "Red Motor Position (mm)"=0) -> (instance out=w46)
              Insert Into Array(inArray=s10, index0=i3, new=w46) -> w47
              case (w7) {
                frame False, Default { }
                frame True {
                  Wait Until Next Multiple(multiple to wait=300)
                  w48 = "Please Save the spectrum file\non the oceanview software\nbefore continuing."
                  One Button Dialog(button name ("OK")="Okay, I will", message=w48)
                }
              }
              next s9 = w44
              next s10 = w47
              next s11 = w42
              next s12 = w43
            }
            call "KCube Motors Close.gvi"(Instrument Coms Info In=s11, Error In=s9) -> (Instrument Coms Info Out=w11, Error Out=w12)
            Property Node(instance in=w10, "Rainbow Sweep Types"=w9, "MSpot Spectrum Data Array"=s10) -> (instance out=w13)
            w14 = s12
          }
          frame "Blue Sweep Closing" {
            call "KCube Initialize and Home.gvi"(Instrument Coms Info In=s3, Debugging Cluster In=s4, Error In=s2, KCube Motor Selector="Red Motor") -> (Instrument Coms Info Out=w49, Debugging Cluster Out=w50, Error Out=w51)
            s13 = w51  # shift register
            s14 = "MSpot Spectrum Data.gtype"[] []  # shift register
            s15 = w50  # shift register
            s16 = w49  # shift register
            for (N = w8) (iteration -> i4) {
              Property Node(instance in=$"MSpot Spectrum Calibration Parameters In") -> ("Min Position (mm)"=w52, "Position step size (mm)"=w53)
              To Double Precision Float(number=i4) -> w54
              Multiply(w53, w54) -> w55
              Add(w52, w55) -> w56
              call "KCube Motor Single Move to Position.gvi"(Instrument Coms Info In=s16, Debugging Cluster In=s15, Motor Position to move to (mm)=w56, Error In=s13, KCube Motor Selector="Red Motor") -> (Instrument Coms Info Out=w57, Debugging Cluster Out=w58, Error Out=w59)
              call "Random Data Generator.gvi"() -> (Beam Spectrum=w60)
              Property Node(instance in="MSpot Spectrum Data.gtype" {all zero or empty}, "M Spot Spectrum"=w60, "Red Motor Position (mm)"=w56, "Blue Motor Position (mm)"=0) -> (instance out=w61)
              Insert Into Array(inArray=s14, index0=i4, new=w61) -> w62
              case (w7) {
                frame False, Default { }
                frame True {
                  Wait Until Next Multiple(multiple to wait=300)
                  w63 = "Please Save the spectrum file\non the oceanview software\nbefore continuing."
                  One Button Dialog(button name ("OK")="Okay, I will", message=w63)
                }
              }
              next s13 = w59
              next s14 = w62
              next s15 = w58
              next s16 = w57
            }
            call "KCube Motors Close.gvi"(Instrument Coms Info In=s16, Error In=s13) -> (Instrument Coms Info Out=w11, Error Out=w12)
            Property Node(instance in=w10, "Rainbow Sweep Types"=w9, "MSpot Spectrum Data Array"=s14) -> (instance out=w13)
            w14 = s15
          }
          frame "Blue Sweep Opening" {
            call "KCube Initialize and Home.gvi"(Instrument Coms Info In=s3, Debugging Cluster In=s4, Error In=s2, KCube Motor Selector="Red Motor") -> (Instrument Coms Info Out=w64, Debugging Cluster Out=w65, Error Out=w66)
            s17 = w66  # shift register
            s18 = "MSpot Spectrum Data.gtype"[] []  # shift register
            s19 = w65  # shift register
            s20 = w64  # shift register
            for (N = w8) (iteration -> i5) {
              Property Node(instance in=$"MSpot Spectrum Calibration Parameters In") -> ("Position step size (mm)"=w67, "Max Position (mm)"=w68)
              To Double Precision Float(number=i5) -> w69
              Multiply(w67, w69) -> w70
              Subtract(x=w68, y=w70) -> w71
              call "KCube Motor Single Move to Position.gvi"(Instrument Coms Info In=s20, Debugging Cluster In=s19, Motor Position to move to (mm)=w71, Error In=s17, KCube Motor Selector="Red Motor") -> (Instrument Coms Info Out=w72, Debugging Cluster Out=w73, Error Out=w74)
              call "Random Data Generator.gvi"() -> (Beam Spectrum=w75)
              Property Node(instance in="MSpot Spectrum Data.gtype" {all zero or empty}, "M Spot Spectrum"=w75, "Red Motor Position (mm)"=w71, "Blue Motor Position (mm)"=0) -> (instance out=w76)
              Insert Into Array(inArray=s18, index0=i5, new=w76) -> w77
              case (w7) {
                frame False, Default { }
                frame True {
                  Wait Until Next Multiple(multiple to wait=300)
                  w78 = "Please Save the spectrum file\non the oceanview software\nbefore continuing."
                  One Button Dialog(button name ("OK")="Okay, I will", message=w78)
                }
              }
              next s17 = w74
              next s18 = w77
              next s19 = w73
              next s20 = w72
            }
            call "KCube Motors Close.gvi"(Instrument Coms Info In=s20, Error In=s17) -> (Instrument Coms Info Out=w11, Error Out=w12)
            Property Node(instance in=w10, "Rainbow Sweep Types"=w9, "MSpot Spectrum Data Array"=s18) -> (instance out=w13)
            w14 = s19
          }
        }
        Insert Into Array(inArray=s1, index0=i1, new=w13) -> w79
        next s1 = w79
        next s2 = w12
        next s3 = w11
        next s4 = w14
      }
      w1 = s1
      w2 = s2
      w3 = s3
      w4 = s4
    }
  }
  $"Instrument Coms Info Out" <- w3
  $"Debugging Cluster Out" <- w4
  $"Full MSpot Multispectral Data Array" <- w1
  $"Error Out" <- w2
