vi "MSpot Spectrum Visualizer.gvi"   [LabVIEW NXG 5.0.0]
inputs:
  "Error In": error
  "Full MSpot Multispectral Data Array": "Full MSpot Multispectral Data.gtype"[]
outputs:
  "Error Out": error
panel controls:
  "Sweep Type Selector": i32
  "Graph (position) Selector": i32
  "Continue": bool
  "cutoff frequency": f64 = 0.125
  "Threshold": f64
panel indicators:
  "Rainbow Sweep Type": "Rainbow Sweep Types.gtype"
  "M Spot Spectrum": cluster{"Element 1": f64[], "Element 2": f64[]}[]
  "MSpot Spectrum Data": "MSpot Spectrum Data.gtype"
types:
  "Rainbow Sweep Types.gtype" = enum{"Red Sweep Closing", "Red Sweep Opening", "Blue Sweep Closing", "Blue Sweep Opening"}
  "MSpot Spectrum Data.gtype" = cluster{"M Spot Spectrum": cluster{"Wavelength": f64[], "Counts": f64[]}, "Blue Motor Position (mm)": f64, "Red Motor Position (mm)": f64, "Dividing Wavelength (nm)": f64}
  "Full MSpot Multispectral Data.gtype" = cluster{"MSpot Spectrum Data Array": "MSpot Spectrum Data.gtype"[], "Rainbow Sweep Types": "Rainbow Sweep Types.gtype"}
uses:
  Rainbow Measurement Setup::Main Functions::One Time Calibrations::MSpot Spectrum::Dividing Wavelength Calculations::Dividing Wavelength Calculator.gvi
  NI::Analysis::IntegralDifferentiation::Derivative x(t).gvi
  NI::Analysis::Filtering::Butterworth Lowpass Filter (DBL).gvi
diagram:
  Property Node(instance in=reference to unnamed native front panel, error in=$"Error In") -> ("Window"=w1, error out=w2)
  Open Window(reference in=w1, error in=w2) -> (reference out=w3, error out=w4)
  # This subVI allows us to visualize the data obtained on the Measuring Spot Spectrum Calibration subroutine so that we can
  # extract our own conclusions and elaborate the calibration file.
  case (w4) {
    frame Error, Default {
      w5 = w4
      w6 = w3
    }
    frame No Error {
      Is Empty Array(array=$"Full MSpot Multispectral Data Array") -> w7
      case (w7) {
        frame True {
          One Button Dialog(button name ("OK")="Oh, sorry", message="No Calibration Found")
          w5 = w4
        }
        frame False {
          while {
            call "Dividing Wavelength Calculator.gvi"(Full MSpot Multispectral Data Array In=$"Full MSpot Multispectral Data Array", Error In=w4, Dividing Wavelength Threshold=$Threshold, cutoff frequency=$"cutoff frequency") -> (Full MSpot Multispectral Data Array Out=w8, Error Out=w9)
            Array Index(array=w8) -> (out0[$"Sweep Type Selector"]=w10)
            Property Node(instance in=w10) -> ("MSpot Spectrum Data Array"=w11, "Rainbow Sweep Types"=w12)
            Array Size(array=w11) -> (size(s)=w13)
            Decrement(x=w13) -> w14
            Array Index(array=w11) -> (out0[$"Graph (position) Selector"]=w15, out1[w14]=w16)
            Property Node(instance in=w15) -> ("M Spot Spectrum"=w17, "Dividing Wavelength (nm)"=w18)
            Property Node(instance in=w17) -> ("Wavelength"=w19, "Counts"=w20)
            Property Node(instance in=w16) -> ("M Spot Spectrum"=w21)
            Property Node(instance in=w21) -> ("Counts"=w22)
            Is Empty Array(array=w20) -> w23
            case (w23) {
              frame True { }
              frame False {
                Build Cluster(w19, w20)
                call "Derivative x(t).gvi"(x(t)=w20) -> (dx(t)/dt=w24)
                Absolute Value(x=w24) -> w25
                call "Butterworth Lowpass Filter (DBL).gvi"(signal=w25, cutoff frequency=$"cutoff frequency") -> (filtered signal=w26)
                Build Cluster(w19, w26)
                Build Cluster(w19, w25)
                Divide(x=w20, y=w22) -> w27
                Build Cluster(w19, w27) -> w28
                Build Array(w28) -> w29
                $"M Spot Spectrum" <- w29
                Build Cluster(w19, w22)
              }
            }
            $"MSpot Spectrum Data" <- w15
            Wait Until Next Multiple(multiple to wait=50)
            Property Node(instance in=reference to "M Spot Spectrum") -> ("Cursor"=w30)
            Property Node(instance in=w30, "XPosition"=w18, "Visible"=TRUE)
            $"Rainbow Sweep Type" <- w12
            Array Size(array=w8) -> (size(s)=w31)
            Decrement(x=w31) -> w32
            Is Equal To 0(x=w32) -> w33
            Not(x=w33) -> w34
            Property Node(instance in=reference to "Sweep Type Selector", "Maximum"=w32, "Minimum"=0, "Visible"=w34, error in=w9) -> (error out=w35)
            Array Size(array=w11) -> (size(s)=w36)
            Decrement(x=w36) -> w37
            Property Node(instance in=reference to "Graph (position) Selector", "Minimum"=0, "Maximum"=w37, error in=w35) -> (error out=w5)
            stop if $Continue
          }
        }
      }
      w6 = w3
    }
  }
  Close Window(reference in=w6, error in=w5) -> (error out=w38)
  $"Error Out" <- w38
