vi "Single Rainbow Measurement Subroutine.gvi"   [LabVIEW NXG 5.0.0]
panel controls:
  "Error In": error
  "Rainbow Sweep Param Selector": "Rainbow Sweep Param Selector.gtype" = {0, 1100, 300, 1, 1, 0}
  "Stand Alone?": bool
  "Debugging Cluster In": "Debugging Cluster.gtype"
  "Instrument Coms Info In": "Instrument Coms Info.gtype"
  "Default Data Saving Location": path
  "Cell Naming Cluster": "Cell Naming Cluster.gtype"
  "SRM Operation Control": "SRM Operation Control.gtype" = "New Measurement"
panel indicators:
  "Instuments Coms Info Out": "Instrument Coms Info.gtype"
  "Debugging Cluster Out": "Debugging Cluster.gtype"
  "Error Out": error
types:
  "Raibow Sweep Selector.gtype" = enum{"Red Sweep", "Blue Sweep", "Full Sweep Red First", "Full Sweep Blue First"}
  "Rainbow Sweep Type Selector.gtype" = cluster{"Red Sweep Mode": enum{"Red Sweep Closing", "Red Sweep Opening"}, "Blue Sweep Mode": enum{"Blue Sweep Opening", "Blue Sweep Closing"}}
  "Rainbow Sweep Param Selector.gtype" = cluster{"Raibow Sweep Selector": "Raibow Sweep Selector.gtype", "Max Wavelength (nm)": f64, "Min Wavelength (nm)": f64, "Wavelength Step (nm)": f64, "Rainbow Sweep Types": "Rainbow Sweep Type Selector.gtype"}
  "Insturment Debugging Cluster.gtype" = cluster{"Keithley": bool, "Arduinos": bool, "Thorlabs Motors": bool, "Photodetector": bool}
  "Debugging Cluster.gtype" = cluster{"Debugging mode?": bool, "Initialize App": bool, "Insturment Debugging": "Insturment Debugging Cluster.gtype"}
  T1 = cluster{"Element 1": "VISA Instr", "Element 2": string}
  "Arduino Detection cluster control.gtype" = cluster{"XZ Stage Arduino Address": "VISA Instr", "XZ Stage Arduino Detected?": bool, "Multiplexer Arduino Detected?": bool, "Multiplexer Arduino Address": "VISA Instr", "Arduinos List": T1[], "XZ Stage Log": string, "Multiplexer Log": string}
  "Thorlabs Motors Serial Number In.gtype" = cluster{"Thorlabs Blue Motor": string, "Thorlabs Red Motor": string, "Blue Motor Homed?": bool, "Red Motor Homed?": bool}
  "Instrument Coms Info.gtype" = cluster{"Arduino Coms Info": "Arduino Detection cluster control.gtype", "Photodetector Names": string[], "Keythley Address": "VISA Instr", "Photodetector Detected?": bool, "Thorlabs Motors Detected?": bool, "Keithley Detected?": bool, "Thorlabs Motors Serial Number": "Thorlabs Motors Serial Number In.gtype", "Photodetector IVI session": "Ivi IviDefault"}
  "Cell Naming Cluster.gtype" = cluster{"Cell Label": string, "Sample Prefix": string, "Author Initials": string, "Current Date": string, "Batch Name": string}
  "SRM Operation Control.gtype" = enum{"New Measurement", "Load Measurement", "Save Measurement"}
uses:
  Rainbow Measurement Setup::Main Functions::Instruction Queue::Current State::FGV Current State.gvi
  Rainbow Measurement Setup::Side Functions::Global Abort::FGV Global Abort.gvi
  Rainbow Measurement Setup::Main Functions::Rainbow Measurement::Cell Rainbow Single Measurement::Single Rainbow Measurement Start Calculator.gvi
  Rainbow Measurement Setup::Side Functions::Instrument Control::Thorlabs Motors::Dividing Wavelength Control::Dividing Wavelength Calibration Data FGV.gvi
  Rainbow Measurement Setup::Side Functions::Instrument Control::Debug Cluster Instrument Extractor.gvi
  Rainbow Measurement Setup::Main Functions::One Time Calibrations::Beam Power Density::Specific Detect Instruments Subroutine.gvi
  Rainbow Measurement Setup::Side Functions::Instrument Control::Thorlabs Motors::Movement::KCube Move to 0 or Home.gvi
  Rainbow Measurement Setup::Side Functions::Instrument Control::Arduino::XZ Stage Arduino::XZ Stage Initialize And Home.gvi
  Rainbow Measurement Setup::Side Functions::Instrument Control::Keithley::Keithley Initialize Subroutine.gvi
  Rainbow Measurement Setup::Side Functions::Instrument Control::Arduino::XZ Stage Arduino::XZ Stage Close Coms.gvi
  Rainbow Measurement Setup::Side Functions::Instrument Control::Thorlabs Motors::Movement::KCube Motors Close.gvi
  Rainbow Measurement Setup::Side Functions::Instrument Control::Keithley::Keithley Close Subroutine.gvi
  Rainbow Measurement Setup::Main Functions::Rainbow Measurement::Cell Rainbow Single Measurement::File Handling::Single Measurement Save Graphs Prompt.gvi
  Rainbow Measurement Setup::Main Functions::Rainbow Measurement::Cell Rainbow Single Measurement::File Handling::Single Measurement Load Prompt.gvi
  Rainbow Measurement Setup::Side Functions::Messages And Prompts::General Simple Prompt.gvi
  Rainbow Measurement Setup::Side Functions::Utilities::Progress Handling::Progress FGV.gvi
diagram:
  w1 = $"Rainbow Sweep Param Selector"
  w2 = $"Default Data Saving Location"
  w3 = $"SRM Operation Control"
  w4 = $"Cell Naming Cluster"
  w5 = $"Stand Alone?"
  # This SubVI Measures the Light power for each motor position for each sweep type and outputs the data so that it can be plotted
  # on the main window for checking and for calibration purposes
  case ($"Error In") {
    frame Error, Default {
      w6 = $"Error In"
      w7 = $"Instrument Coms Info In"
      w8 = $"Debugging Cluster In"
    }
    frame No Error {
      call "FGV Current State.gvi"(Current State Instructions="Set Current State and Substate", Current State="Rainbow Single Measurement", Current Substate="", Error In=$"Error In") -> (Error Out=w9)
      s1 = w9  # shift register
      s2 = "Start App"  # shift register
      s3 = $"Debugging Cluster In"  # shift register
      s4 = $"Instrument Coms Info In"  # shift register
      while (after w2) (after w4) (after w1) {
        call "FGV Global Abort.gvi"(Global Abort Instructions="Read Current State", Error In=s1) -> (Local Abort Out=w10, Global Abort Out=w11, Error Out=w12)
        Select(s=w10, t="Close Coms", f=s2) -> w13
        case (w13) {
          frame "Start App", Default {
            call "Single Rainbow Measurement Start Calculator.gvi"(SRM Operation Control=w3, Stand Alone?=w5) -> (Desired State=w15)
            call "FGV Current State.gvi"(Current State Instructions="Set Current Substate", Current Substate="Starting Light Power Calibration", Error In=w12) -> (Error Out=w14)
            w16 = default
            w17 = _
            w18 = _
          }
          frame "Detect Instruments" {
            call "FGV Current State.gvi"(Current State Instructions="Set Current Substate", Current Substate="Detecting Instruments", Error In=w12) -> (Error Out=w19)
            call "Dividing Wavelength Calibration Data FGV.gvi"(General FGV Instructions="Set State", Error In=w19) -> (Error Out=w20)
            call "Debug Cluster Instrument Extractor.gvi"(Debugging Cluster In=s3, Error In=w20) -> (Debuging Cluster Out=w17, Instruments to Detect=w21, Error Out=w22)
            call "Specific Detect Instruments Subroutine.gvi"(Instrument Coms Info In=s4, Error In=w22, Instruments To Detect Array=w21) -> (Instrument Coms Info Out=w18, Error Out=w14)
            w15 = "Initialize Instruments"
            w16 = default
          }
          frame "Initialize Instruments" {
            call "FGV Current State.gvi"(Current State Instructions="Set Current Substate", Current Substate="Initializing Instruments", Error In=w12) -> (Error Out=w23)
            call "KCube Move to 0 or Home.gvi"(Instrument Coms Info In=s4, Debugging Cluster In=s3, Error In=w23) -> (Instrument Coms Info Out=w24, Debugging Cluster Out=w25, Error Out=w26)
            call "XZ Stage Initialize And Home.gvi"(Instrument Coms Info In=w24, Debugging Cluster In=w25, Error In=w26) -> (Instrument Coms Info Out=w27, Debugging Cluster Out=w28, Error Out=w29)
            call "Keithley Initialize Subroutine.gvi"(Instrument Coms Info In=w27, Debugging Cluster In=w28, Error In=w29) -> (Instrument Coms Info Out=w18, Debugging Cluster Out=w17, Error Out=w14)
            w15 = "Rainbow Sweep"
            w16 = default
          }
          frame "Rainbow Sweep" {
            call "FGV Current State.gvi"(Current State Instructions="Set Current Substate", Current Substate="Acquiring Spectra", Error In=w12) -> (Error Out=w14)
            w15 = _
            w16 = default
            w17 = _
            w18 = _
          }
          frame "Close Coms" {
            call "FGV Current State.gvi"(Current State Instructions="Set Current Substate", Current Substate="Closing Coms", Error In=w12) -> (Error Out=w30)
            call "XZ Stage Close Coms.gvi"(Instrument Coms Info In=s4, Error In=w30) -> (Instrument Coms Info Out=w31, Error Out=w32)
            call "KCube Motors Close.gvi"(Instrument Coms Info In=w31, Error In=w32) -> (Instrument Coms Info Out=w33, Error Out=w34)
            call "Keithley Close Subroutine.gvi"(Instrument Coms Info In=w33, Debugging Cluster In=s3, Error In=w34) -> (Instrument Coms Info Out=w18, Debugging Cluster Out=w17, Error Out=w35)
            call "Single Measurement Save Graphs Prompt.gvi"(Error In=w35) -> (Desired State=w36, Error Out=w14)
            Select(s=w10, t="Stop App", f=w36) -> w15
            w16 = default
          }
          frame "Load Measurement" {
            call "FGV Current State.gvi"(Current State Instructions="Set Current Substate", Current Substate="Loading Calibration", Error In=w12) -> (Error Out=w37)
            call "Single Measurement Load Prompt.gvi"(Error In=w37) -> (Error Out=w14)
            w15 = _
            w16 = default
            w17 = s3
            w18 = s4
          }
          frame "Save Graphs" {
            call "FGV Current State.gvi"(Current State Instructions="Set Current Substate", Current Substate="Saving Graphs", Error In=w12) -> (Error Out=w38)
            w39 = "Your Measurement Files Have been saved\npropperly on your personal data folder."
            call "General Simple Prompt.gvi"(Prompt Message=w39, Okay Button Message="Perfect Thanks :)", Error In=w38, Prompt?=TRUE) -> (Error Out=w14)
            w15 = "Stop App"
            w16 = default
            w17 = s3
            w18 = s4
          }
          frame "Stop App" {
            call "FGV Current State.gvi"(Current State Instructions="Set Current Substate", Current Substate="Stopping Apps", Error In=w12) -> (Error Out=w14)
            w15 = "Start App"
            w16 = TRUE
            w17 = s3
            w18 = s4
          }
        }
        call "Progress FGV.gvi"(FGV Instructions="Set State", Progress In=0, Error In=w14) -> (Error Out=w40)
        Logical Or(w11, w40, w16) -> w41
        next s1 = w40
        next s2 = w15
        next s3 = w17
        next s4 = w18
        stop if w41
      }
      w6 = s1
      w7 = s4
      w8 = s3
    }
  }
  $"Instuments Coms Info Out" <- w7
  $"Debugging Cluster Out" <- w8
  $"Error Out" <- w6
