vi "SRM file handling.gvi"   [LabVIEW NXG 5.0.0]
inputs:
  "Error In": error
  "Default Data Saving Location": path
  "Modify File Operation": "Modify File Operation.gtype" = "Save TXT"
  "IV Full Data Cluster": "IV Full Data Cluster.gtype"[]
  "Cell Naming Cluster": "Cell Naming Cluster.gtype"
outputs:
  "Error Out": error
  "IV Full Raw Data Out": "IV Full Raw Data.gtype"[]
  "Found Any Folder?": bool
  "Canceled Loading?": bool
  "Loaded Files": string[]
  "Duplicate Measurement Files?": bool
  "Found Files Within all Folders?": bool
types:
  "Modify File Operation.gtype" = enum{"Save TXT", "Load TXT"}
  "Cell Naming Cluster.gtype" = cluster{"Cell Label": string, "Sample Prefix": string, "Author Initials": string, "Current Date": string, "Batch Name": string}
  "IV Single Measurement.gtype" = cluster{"Voltage": f64[], "Current": f64[], "Current Density": f64[], "Dividing Wavelength": f64, "Light Power": f64}
  "Rainbow Sweep Types.gtype" = enum{"Red Sweep Closing", "Red Sweep Opening", "Blue Sweep Closing", "Blue Sweep Opening"}
  "IV Refined Full Sweep Data.gtype" = cluster{"Rs (Ω/m^2)": f64[], "Rsh (Ω/m^2)": f64[], "Jsc (A/m^2)": f64[], "Voc (V)": f64[], "FF (%)": f64[], "Efficiency (%)": f64[], "Dividing Wavelength (nm)": f64[], "Light Power (W)": f64[]}
  "IV Full Data Cluster.gtype" = cluster{"IV Measurements Array": "IV Single Measurement.gtype"[], "Rainbow Sweep Types": "Rainbow Sweep Types.gtype", "IV Refined Data": "IV Refined Full Sweep Data.gtype"}
  "IV Full Raw Data.gtype" = cluster{"Rainbow Sweep Types": "Rainbow Sweep Types.gtype", "IV Raw Data Array": "IV Single Measurement.gtype"[]}
uses:
  Rainbow Measurement Setup::Side Functions::Messages And Prompts::Select path prompt.gvi
  Rainbow Measurement Setup::Side Functions::Path Manipulation::File_FolderName Scan For Sweep.gvi
  Rainbow Measurement Setup::Main Functions::Modify TXT file::Modify Measurement TXT File.gvi
  Rainbow Measurement Setup::Main Functions::Rainbow Measurement::Cell Single Rainbow Measurement::File Handling::SRM Header Info Extractor.gvi
  Rainbow Measurement Setup::Side Functions::Utilities::Array Detect Duplicates.gvi
  Rainbow Measurement Setup::Side Functions::Messages And Prompts::FGV Repeat Operation for all following files.gvi
diagram:
  # This subVI Handles the Saving of all the Single Rainbow Measurement files. It can both save and load the files from a specified folder and to the user folder respectively
  case ($"Error In") {
    frame Error, Default {
      w1 = $"Error In"
      w2 = default
      w3 = default
      w4 = default
      w5 = default
      w6 = default
      w7 = default
    }
    frame No Error {
      case ($"Modify File Operation") {
        frame "Load TXT" {
          w9 = "Please Select the folder with the Rainbow Measurement Files you want to Load. "
          w10 = "Please select the cell folder within the device you want to analyze (i.e. L12)"
          call "Select path prompt.gvi"(Main Message=w9, Sub message=w10, Error In=$"Error In", Cancel Available?=TRUE) -> (New Path=w11, Cancelled?=w12, Error Out=w13)
          case (w12) {
            frame True {
              w7 = default
              w8 = w13
              w3 = TRUE
              w4 = default
              w2 = TRUE
              w5 = default
              w6 = default
            }
            frame False {
              List Folder(error in=w13, path=w11) -> (error out=w14, folder names=w15, path out=w16)
              s1 = w14  # shift register
              s2 = 0  # shift register
              s3 = "IV Full Raw Data.gtype"[] []  # shift register
              for {
                w17 = each element of w15
                Build Path(base path=w16, name or relative path=w17) -> (appended path=w21)
                Search And Replace String(error in (no error)=s1, input string=w17, search string="Raw IV Curves") -> (error out=w22, number of replacements=w23)
                call "File_FolderName Scan For Sweep.gvi"(FileName/FolderName In=w17, Error In=w22) -> (Is File/Folder sweep type?=w24, Sweep Type=w25, Error Out=w26)
                Is Not Equal To 0(x=w23) -> w27
                Logical And(w27, w24) -> w28
                case (w28) {
                  frame False, Default {
                    w29 = s2
                    w30 = s3
                    w31 = w26
                    w32 = default
                    w33 = "Red Sweep Closing"
                    w34 = default
                  }
                  frame True {
                    Increment(x=s2) -> w29
                    Array Index(array=s3) -> (out0[s2]=w35)
                    Property Node(instance in=w35) -> ("IV Raw Data Array"=w36)
                    List Folder(error in=w26, path=w21) -> (error out=w37, file names=w38, path out=w39)
                    s4 = w37  # shift register
                    s5 = w36  # shift register
                    s6 = 0  # shift register
                    for {
                      w40 = each element of w38
                      Build Path(base path=w39, name or relative path=w40) -> (appended path=w42)
                      Search And Replace String(input string=w40, search string=".txt") -> (number of replacements=w43)
                      Is Not Equal To 0(x=w43) -> w44
                      case (w44) {
                        frame False, Default {
                          w45 = s4
                          w46 = s5
                          w47 = s6
                          w48 = default
                        }
                        frame True {
                          Increment(x=s6) -> w47
                          call "Modify Measurement TXT File.gvi"(Filename to load/save=w42, Modify File Operation="Load TXT", Error In=s4, Measurement File Type="Single Cell Rainbow Raw") -> (Loaded Data=w49, Header Data=w50, Error Out=w51)
                          Array Index(array=w49) -> (out0[_, 0]=w52, out1[_, 1]=w53, out2[_, 2]=w54)
                          call "SRM Header Info Extractor.gvi"(Header Data=w50, Error In=w51) -> (Dividing Wavelength=w55, Light Power=w56, Error Out=w45)
                          Property Node(instance in="IV Single Measurement.gtype" {all zero or empty}, "Voltage"=w52, "Current"=w53, "Current Density"=w54, "Dividing Wavelength"=w55, "Light Power"=w56) -> (instance out=w57)
                          Insert Into Array(inArray=s5, index0=s6, new=w57) -> w46
                          w48 = TRUE
                        }
                      }
                      append w48 to w41
                      next s4 = w45
                      next s5 = w46
                      next s6 = w47
                    }
                    Or Array Elements(Boolean array=w41) -> (logical OR=w34)
                    Property Node(instance in=w35, "IV Raw Data Array"=s5, "Rainbow Sweep Types"=w25) -> (instance out=w58)
                    Insert Into Array(inArray=s3, new=w58) -> w30
                    w31 = s4
                    w32 = TRUE
                    w33 = w25
                  }
                }
                append w32 to w18
                append w17 to w4 if w28
                append w33 to w19 if w28
                append w34 to w20
                next s1 = w31
                next s2 = w29
                next s3 = w30
              }
              Or Array Elements(Boolean array=w18) -> (logical OR=w2)
              Or Array Elements(Boolean array=w20) -> (logical OR=w6)
              call "Array Detect Duplicates.gvi"(Array In=w19, Error In=s1) -> (Repeated?=w5, Error Out=w8)
              w7 = s3
              w3 = default
            }
          }
        }
        frame "Save TXT", Default {
          s7 = $"Error In"  # shift register
          for {
            w59 = each element of $"IV Full Data Cluster"
            Property Node(instance in=w59) -> ("IV Measurements Array"=w60, "Rainbow Sweep Types"=w61, "IV Refined Data"=w62)
            s8 = s7  # shift register
            for {
              w63 = each element of w60
              Property Node(instance in=$"Cell Naming Cluster") -> ("Sample Prefix"=w64, instance out=w65)
              Property Node(instance in=w63) -> ("Voltage"=w66, "Current"=w67, "Current Density"=w68, "Dividing Wavelength"=w69, "Light Power"=w70)
              Format Into String(formatString="%d", errIn=s8, w69) -> (outString=w71, errOut=w72)
              Concatenate Strings(w64, ".", w71, "nm") -> w73
              Property Node(instance in=w65, "Sample Prefix"=w73) -> (instance out=w74)
              Concatenate Strings(" Dividing Wavelength (nm) = ", w71, "  Light Power (W) = ") -> w75
              Format Into String(initString=w75, errIn=w72, w70) -> (outString=w76, errOut=w77)
              Build Array(w66, w67, w68) -> w78
              Transpose 2D Array(2D array=w78) -> (transposed array=w79)
              call "Modify Measurement TXT File.gvi"(Variable Header Info=w76, Rainbow Sweep Types=w61, Default Data Saving Location=$"Default Data Saving Location", Modify File Operation="Save TXT", Data To Save=w79, Error In=w77, Cell Naming Cluster=w74, Measurement File Type="Single Cell Rainbow Raw") -> (Error Out=w80)
              next s8 = w80
            }
            Property Node(instance in=w62) -> ("Dividing Wavelength (nm)"=w81, "Light Power (W)"=w82, "Jsc (A/m^2)"=w83, "Voc (V)"=w84, "FF (%)"=w85, "Efficiency (%)"=w86, "Rs (Ω/m^2)"=w87, "Rsh (Ω/m^2)"=w88)
            Build Array(w81, w82, w83, w84, w85, w86, w87, w88) -> w89
            Transpose 2D Array(2D array=w89) -> (transposed array=w90)
            call "Modify Measurement TXT File.gvi"(Rainbow Sweep Types=w61, Default Data Saving Location=$"Default Data Saving Location", Modify File Operation="Save TXT", Data To Save=w90, Error In=s8, Cell Naming Cluster=$"Cell Naming Cluster", Measurement File Type="Single Cell Rainbow Refined") -> (Error Out=w91)
            next s7 = w91
          }
          w8 = s7
          w2 = default
          w3 = default
          w4 = default
          w5 = default
          w6 = default
          w7 = default
        }
      }
      call "FGV Repeat Operation for all following files.gvi"(FGV Instructions="Reset State", Error In=w8) -> (Error Out=w1)
    }
  }
  $"Canceled Loading?" <- w3
  $"Found Any Folder?" <- w2
  $"Error Out" <- w1
  $"Found Files Within all Folders?" <- w6
  $"IV Full Raw Data Out" <- w7
  $"Duplicate Measurement Files?" <- w5
  $"Loaded Files" <- w4
