vi "Single Rainbow Measurement Subroutine.gvi"   [LabVIEW NXG 5.0.0]
inputs:
  "Error In": error
  "Instruction Queue In": Queue<"Queue Instructions Control.gtype">
  "Stand Alone?": bool
  "Debugging Cluster In": "Debugging Cluster.gtype"
  "Instrument Coms Info In": "Instrument Coms Info.gtype"
  "Default Data Saving Location": path
  "Cell Naming Cluster": "Cell Naming Cluster.gtype"
  "Rainbow Tab Reference": "TabControl reference"
  "Rainbow Sweep Param Selector": "Rainbow Sweep Param Selector.gtype" = {0, 1100, 300, 1, 1, 0}
  "SRM Specific Parameters": "SRM Specific Parameters.gtype"
  "Light Power Calibration Data": "Light Power Calibration Data.gtype"[]
outputs:
  "Error Out": error
  "Instuments Coms Info Out": "Instrument Coms Info.gtype"
  "Debugging Cluster Out": "Debugging Cluster.gtype"
  "Instruction Queue Out": Queue<"Queue Instructions Control.gtype">
  "FulL IV data Cluster": "IV Full Data Cluster.gtype"[]
  "SRM Rainbow Parameters": "Rainbow Sweep Param Selector.gtype"
panel controls:
  "Rainbow Measurement tab": i32
  "Light Power Calibration": cluster{"Wavelength": f64[], "Power": f64[]}[]
  "New Light Power Calibration": bool
  "Load Light Power Calibration": bool
  "Save Light Power Calibration": bool
  "Sweep Live Parameters LPC": "LPC Sweep Live Parameters.gtype"
  "LPC Parameters": "Light power Calibration Parameters.gtype" = {"Powermeter Averages"=3}
  "Rainbow Sweep Parameters LPC": "Rainbow Sweep Param Selector.gtype" = {0, 1100, 300, 1, 1, 0}
  "IV Plot Out": "SRM Single Plot Cluster.gtype"[]
  "Acquire Single Rainbow Button": bool
  "Load Single Measurement": bool
  "Save Single Measurement": bool
  "Rainbow Sweep Parameters RSM": "Rainbow Sweep Param Selector.gtype" = {0, 1100, 300, 1, 1, 0}
  "Sweep Live Parameters RSM": "SRM Sweep Live Parameters.gtype"
  "SRM Specific Parameters_2": "SRM Specific Parameters.gtype" = {"Max (V)"=1.2, "Min (V)"=-0.2, "V Points"=100, "Current Range (A)"=0.1, "Autorange"=TRUE, "Sweep Dir"=FALSE, "Current Averages"=3, "Max (A)"=1, "Integration Time"=0.5, "Cell Area (m^2)"=8e-06}
  "SRM Raw Plot Rainbow Sweep Selector": string
  "IV Extracted Parameter Plot": T5
  "SRM Plot Parameter Selector": "SRM Refined Plot Parameter Selector.gtype" = "Efficiency (%)"
  "SRM Refined Plot Rainbow Sweep Types": string
  "SRM Operation Control": "SRM Operation Control.gtype" = "New Measurement"
types:
  "Insturment Debugging Cluster.gtype" = cluster{"Keithley": bool, "Arduinos": bool, "Thorlabs Motors": bool, "Photodetector": bool, "Flame Spectr": bool}
  "Debugging Cluster.gtype" = cluster{"Debugging mode?": bool, "Initialize App": bool, "Insturment Debugging": "Insturment Debugging Cluster.gtype"}
  T1 = cluster{"Element 1": "VISA Instr", "Element 2": string}
  "Arduino Detection cluster control.gtype" = cluster{"XZ Stage Arduino Address": "VISA Instr", "XZ Stage Arduino Detected?": bool, "Multiplexer Arduino Detected?": bool, "Multiplexer Arduino Address": "VISA Instr", "Arduinos List": T1[], "XZ Stage Log": string, "Multiplexer Log": string}
  "Thorlabs Motors Serial Number In.gtype" = cluster{"Thorlabs Blue Motor": string, "Thorlabs Red Motor": string, "Blue Motor Homed?": bool, "Red Motor Homed?": bool}
  "Instrument Coms Info.gtype" = cluster{"Arduino Coms Info": "Arduino Detection cluster control.gtype", "Photodetector Names": string[], "Keythley Address": "VISA Instr", "Photodetector Detected?": bool, "Thorlabs Motors Detected?": bool, "Keithley Detected?": bool, "Thorlabs Motors Serial Number": "Thorlabs Motors Serial Number In.gtype", "Photodetector IVI session": "Ivi IviDefault", "Flame ID": string, "Flame Detected?": bool, "Flame Wrapper ID": u64}
  "Cell Naming Cluster.gtype" = cluster{"Cell Label": string, "Sample Prefix": string, "Author Initials": string, "Current Date": string, "Batch Name": string}
  "Raibow Sweep Selector.gtype" = enum{"Red Sweep", "Blue Sweep", "Full Sweep Red First", "Full Sweep Blue First"}
  T2 = enum{"Red Sweep Closing", "Red Sweep Opening", "Red Sweep Both Ways"}
  T3 = enum{"Blue Sweep Opening", "Blue Sweep Closing", "Blue Sweep Both Ways"}
  "Rainbow Sweep Type Selector.gtype" = cluster{"Red Sweep Mode": T2, "Blue Sweep Mode": T3}
  "Rainbow Sweep Param Selector.gtype" = cluster{"Raibow Sweep Selector": "Raibow Sweep Selector.gtype", "Max Wavelength (nm)": f64, "Min Wavelength (nm)": f64, "Wavelength Step (nm)": f64, "Rainbow Sweep Type Selector": "Rainbow Sweep Type Selector.gtype"}
  "Queue Instructions Control.gtype" = enum{"Undefined State", "Debug Check", "Initialize App", "Idle", "Light Power Calibration", "Rainbow Single Measurement", "Light Calibration Irradiance", "Light Calibration Spectral Density", "Light Calibration Power Density", "MSpot Spectrum Calibration", "Access TXT File", "Stop App"}
  T4 = cluster{"Dividing Wavelength Array": f64[], "Measured Power Array": f64[]}
  "Rainbow Sweep Types.gtype" = enum{"Red Sweep Closing", "Red Sweep Opening", "Blue Sweep Closing", "Blue Sweep Opening"}
  "Light Power Calibration Data.gtype" = cluster{"Single Light Calibration": T4, "Rainbow Sweep Types": "Rainbow Sweep Types.gtype"}
  "IV Single Measurement.gtype" = cluster{"Voltage": f64[], "Current": f64[], "Current Density": f64[], "Dividing Wavelength": f64, "Light Power": f64}
  "IV Refined Full Sweep Data.gtype" = cluster{"Rs (Ω/m^2)": f64[], "Rsh (Ω/m^2)": f64[], "Jsc (A/m^2)": f64[], "Voc (V)": f64[], "FF (%)": f64[], "Efficiency (%)": f64[], "Dividing Wavelength (nm)": f64[], "Light Power (W)": f64[]}
  "IV Full Data Cluster.gtype" = cluster{"IV Measurements Array": "IV Single Measurement.gtype"[], "Rainbow Sweep Types": "Rainbow Sweep Types.gtype", "IV Refined Data": "IV Refined Full Sweep Data.gtype"}
  "LPC Sweep Live Parameters.gtype" = cluster{"Light Power (W) ": f64, "Current Wavelength (nm)": f64, "Rainbow Sweep Types": "Rainbow Sweep Types.gtype"}
  "Light power Calibration Parameters.gtype" = cluster{"Powermeter Averages": f64}
  "SRM Single Plot Cluster.gtype" = cluster{"Voltage": f64[], "Current Density": f64[]}
  "SRM Sweep Live Parameters.gtype" = cluster{"Current Wavelength (nm)": f64, "Rainbow Sweep Types": "Rainbow Sweep Types.gtype", "Finished Measurement?": bool}
  "SRM Specific Parameters.gtype" = cluster{"Max (V)": f64, "Min (V)": f64, "V Points": u32, "Current Range (A)": f64, "Autorange": bool, "Sweep Dir": bool, "Current Averages": u32, "Max (A)": f64, "Integration Time": f64, "Cell Area (m^2)": f64}
  T5 = cluster{"Dividing Wavelength (nm)": f64[], "Element 2": f64[]}
  "SRM Refined Plot Parameter Selector.gtype" = enum{"Efficiency (%)", "Jsc (A)", "Voc (V)", "Light Power (W)", "FF (%)", "Rs (Ω/m^2)", "Rsh (Ω/m^2)"}
  "SRM Operation Control.gtype" = enum{"New Measurement", "Load Measurement", "Save Measurement"}
  "IV Full Raw Data.gtype" = cluster{"Rainbow Sweep Types": "Rainbow Sweep Types.gtype", "IV Raw Data Array": "IV Single Measurement.gtype"[]}
uses:
  Rainbow Measurement Setup::Main Functions::Rainbow Measurement::Cell Single Rainbow Measurement::SRM Operation FGV.gvi
  Rainbow Measurement Setup::Main Functions::Instruction Queue::Current State::FGV Current State.gvi
  Rainbow Measurement Setup::Side Functions::Global Abort::FGV Global Abort.gvi
  Rainbow Measurement Setup::Main Functions::Rainbow Measurement::Cell Single Rainbow Measurement::SRM Start Calculator.gvi
  Rainbow Measurement Setup::Main Functions::Rainbow Measurement::Cell Single Rainbow Measurement::LPC Check::SRM Check Light Power Data.gvi
  Rainbow Measurement Setup::Side Functions::Instrument Control::Thorlabs Motors::Dividing Wavelength Control::Dividing Wavelength Calibration Data FGV.gvi
  Rainbow Measurement Setup::Side Functions::Instrument Control::Debug Cluster Instrument Extractor.gvi
  Rainbow Measurement Setup::Main Functions::One Time Calibrations::Beam Power Density::Specific Detect Instruments Subroutine.gvi
  Rainbow Measurement Setup::Side Functions::Instrument Control::Thorlabs Motors::Movement::KCube Move to 0 or Home.gvi
  Rainbow Measurement Setup::Side Functions::Instrument Control::Keithley::Keithley Initialize Subroutine.gvi
  Rainbow Measurement Setup::Main Functions::Rainbow Measurement::Cell Single Rainbow Measurement::SRM Rainbow Sweep.gvi
  Rainbow Measurement Setup::Side Functions::Instrument Control::Thorlabs Motors::Movement::KCube Motors Close.gvi
  Rainbow Measurement Setup::Side Functions::Instrument Control::Keithley::Keithley Close Subroutine.gvi
  Rainbow Measurement Setup::Main Functions::Rainbow Measurement::Cell Single Rainbow Measurement::IV Calculations::SRM IV Parameters Calculator.gvi
  Rainbow Measurement Setup::Main Functions::Rainbow Measurement::Cell Single Rainbow Measurement::Plotting::SRM Sweep Refined Data FGV.gvi
  Rainbow Measurement Setup::Main Functions::Rainbow Measurement::Cell Single Rainbow Measurement::File Handling::SRM Save Graphs Prompt.gvi
  Rainbow Measurement Setup::Main Functions::Rainbow Measurement::Cell Single Rainbow Measurement::File Handling::SRM file handling.gvi
  Rainbow Measurement Setup::Main Functions::Rainbow Measurement::Cell Single Rainbow Measurement::File Handling::SRM Load Prompt.gvi
  Rainbow Measurement Setup::Side Functions::Messages And Prompts::General Simple Prompt.gvi
  Rainbow Measurement Setup::Side Functions::Utilities::Wait ms.gvi
  Rainbow Measurement Setup::Side Functions::Utilities::Progress Handling::Progress FGV.gvi
diagram:
  # This SubVI Measures the Light power for each motor position for each sweep type and outputs the data so that it can be plotted
  # on the main window for checking and for calibration purposes
  case ($"Error In") {
    frame Error, Default {
      w1 = $"Error In"
      w2 = $"Instrument Coms Info In"
      w3 = $"Debugging Cluster In"
      w4 = $"Instruction Queue In"
      w5 = default
      w6 = $"Rainbow Sweep Param Selector"
    }
    frame No Error {
      call "SRM Operation FGV.gvi"(FGV Instructions="Read State", Error In=$"Error In") -> (SRM Operation Control Out=w7, Error Out=w8)
      Select(s=$"Stand Alone?", t=$"SRM Operation Control", f=w7) -> w9
      call "FGV Current State.gvi"(Current State Instructions="Set Current State and Substate", Current State="Rainbow Single Measurement", Current Substate="", Error In=w8) -> (Error Out=w10)
      s1 = w10  # shift register
      s2 = "Start App"  # shift register
      s2.prev1 = uninitialised  # shift register
      s3 = $"Debugging Cluster In"  # shift register
      s4 = $"Instrument Coms Info In"  # shift register
      s5 = $"Instruction Queue In"  # shift register
      s6 = $"Rainbow Sweep Param Selector"  # shift register
      s7 = "IV Full Raw Data.gtype"[] []  # shift register
      s8 = "IV Full Data Cluster.gtype"[] []  # shift register
      while {
        call "FGV Global Abort.gvi"(Global Abort Instructions="Read Current State", Error In=s1) -> (Local Abort Out=w11, Global Abort Out=w12, Error Out=w13)
        Is Not Equal(x=s2, y="Stop App") -> w14
        Logical And(w14, w11) -> w15
        Select(s=w15, t="Close Coms", f=s2) -> w16
        case (w16) {
          frame "Start App", Default {
            w26 = "Load Light Power Calibration"  # SRM States
            call "FGV Current State.gvi"(Current State Instructions="Set Current Substate", Current Substate="Starting Light Power Calibration", Error In=w13) -> (Error Out=w17)
            w18 = w26
            w19 = default
            w20 = s3
            w21 = s4
            w22 = s5
            w23 = s6
            w24 = s7
            w25 = s8
          }
          frame "Load Light Power Calibration" {
            call "SRM Start Calculator.gvi"(SRM Operation Control=w9, Stand Alone?=$"Stand Alone?") -> (Desired State=w27)
            call "SRM Check Light Power Data.gvi"(Light Power Calibration Data In=$"Light Power Calibration Data", Rainbow Sweep Param Selector In=s6, Input State=w27, Error In=w13) -> (Rainbow Sweep Param Selector Out=w23, Next State=w18, Error Out=w17)
            w19 = default
            w20 = s3
            w21 = s4
            w22 = s5
            w24 = s7
            w25 = s8
          }
          frame "Detect Instruments" {
            w28 = "Initialize Instruments"  # SRM States
            call "FGV Current State.gvi"(Current State Instructions="Set Current Substate", Current Substate="Detecting Instruments", Error In=w13) -> (Error Out=w29)
            call "Dividing Wavelength Calibration Data FGV.gvi"(General FGV Instructions="Set State", Error In=w29) -> (Error Out=w30)
            call "Debug Cluster Instrument Extractor.gvi"(Debugging Cluster In=s3, Error In=w30) -> (Debuging Cluster Out=w20, Instruments to Detect=w31, Error Out=w32)
            call "Specific Detect Instruments Subroutine.gvi"(Instrument Coms Info In=s4, Error In=w32, Instruments To Detect Array=w31, Stand Alone?=$"Stand Alone?") -> (Instrument Coms Info Out=w21, Error Out=w17)
            w18 = w28
            w19 = default
            w22 = s5
            w23 = s6
            w24 = s7
            w25 = s8
          }
          frame "Initialize Instruments" {
            call "FGV Current State.gvi"(Current State Instructions="Set Current Substate", Current Substate="Initializing Instruments", Error In=w13) -> (Error Out=w33)
            call "KCube Move to 0 or Home.gvi"(Instrument Coms Info In=s4, Debugging Cluster In=s3, Error In=w33) -> (Instrument Coms Info Out=w34, Debugging Cluster Out=w35, Error Out=w36)
            call "Keithley Initialize Subroutine.gvi"(Instrument Coms Info In=w34, Debugging Cluster In=w35, Error In=w36) -> (Instrument Coms Info Out=w21, Debugging Cluster Out=w20, Error Out=w17)
            w37 = "Rainbow Sweep"  # SRM States
            w18 = w37
            w19 = default
            w22 = s5
            w23 = s6
            w24 = s7
            w25 = s8
          }
          frame "Rainbow Sweep" {
            call "FGV Current State.gvi"(Current State Instructions="Set Current Substate", Current Substate="Acquiring Spectra", Error In=w13) -> (Error Out=w38)
            call "SRM Rainbow Sweep.gvi"(Instrument Coms Info In=s4, Debugging Cluster In=s3, SRM Specific Parameters=$"SRM Specific Parameters", Rainbow Sweep Param Selector=s6, Light Power Calibration Data=$"Light Power Calibration Data", Error In=w38) -> (Instrument Coms Info Out=w21, Debugging Cluster Out=w20, Full IV Curve Raw Data=w24, Error Out=w17)
            w39 = "Close Coms"  # SRM States
            w18 = w39
            w19 = default
            w22 = s5
            w23 = s6
            w25 = s8
          }
          frame "Close Coms" {
            w40 = "Process IV Data"  # SRM States
            w41 = "Stop App"  # SRM States
            Select(s=w11, t=w41, f=w40) -> w18
            call "FGV Current State.gvi"(Current State Instructions="Set Current Substate", Current Substate="Closing Coms", Error In=w13) -> (Error Out=w42)
            call "KCube Motors Close.gvi"(Instrument Coms Info In=s4, Error In=w42) -> (Instrument Coms Info Out=w43, Error Out=w44)
            call "Keithley Close Subroutine.gvi"(Instrument Coms Info In=w43, Debugging Cluster In=s3, Error In=w44) -> (Instrument Coms Info Out=w21, Debugging Cluster Out=w20, Error Out=w17)
            w19 = default
            w22 = s5
            w23 = s6
            w24 = s7
            w25 = s8
          }
          frame "Process IV Data" {
            call "SRM IV Parameters Calculator.gvi"(IV Raw Data Array=s7, Error In=w13) -> (IV Full Data Cluster Array=w25, Error Out=w45)
            call "SRM Sweep Refined Data FGV.gvi"(IV Full Data Cluster Array In=w25, Error In=w45, FGV Instructions="Set State") -> (Error Out=w46)
            call "SRM Save Graphs Prompt.gvi"(Previous State=s2.prev1, Error In=w46) -> (Desired State=w18, Error Out=w17)
            w19 = default
            w20 = s3
            w21 = s4
            w22 = s5
            w23 = s6
            w24 = s7
          }
          frame "Load Measurement" {
            call "FGV Current State.gvi"(Current State Instructions="Set Current Substate", Current Substate="Loading Calibration", Error In=w13) -> (Error Out=w47)
            call "SRM file handling.gvi"(Default Data Saving Location=$"Default Data Saving Location", Modify File Operation="Load TXT", Error In=w47) -> (Duplicate Measurement Files?=w48, Found Files Within all Folders?=w49, IV Full Raw Data Out=w24, Found Any Folder?=w50, Loaded Files=w51, Error Out=w52, Canceled Loading?=w53)
            call "SRM Load Prompt.gvi"(Duplicate Measurement Folders?=w48, Found Any Folder?=w50, Found Files within each Folder?=w49, Loaded Files=w51, Error In=w52, Canceled Loading?=w53) -> (Desired State=w18, Error Out=w17)
            w19 = default
            w20 = s3
            w21 = s4
            w22 = s5
            w23 = s6
            w25 = s8
          }
          frame "Save Graphs" {
            w54 = "Stop App"  # SRM States
            call "FGV Current State.gvi"(Current State Instructions="Set Current Substate", Current Substate="Saving Graphs", Error In=w13) -> (Error Out=w55)
            w56 = "Your Measurement Files Have been saved\npropperly on your personal data folder."
            call "General Simple Prompt.gvi"(Prompt Message=w56, Okay Button Message="Perfect Thanks :)", Error In=w55, Prompt?=TRUE) -> (Error Out=w57)
            call "SRM file handling.gvi"(Default Data Saving Location=$"Default Data Saving Location", IV Full Data Cluster=s8, Modify File Operation="Save TXT", Error In=w57, Cell Naming Cluster=$"Cell Naming Cluster") -> (Error Out=w17)
            w18 = w54
            w19 = default
            w20 = s3
            w21 = s4
            w22 = s5
            w23 = s6
            w24 = s7
            w25 = s8
          }
          frame "Enqueue Light Calibration" {
            w58 = "Stop App"  # SRM States
            Enqueue Element(element="Light Power Calibration", error in=w13, queue=s5) -> (error out=w59, queue out=w22)
            Property Node(instance in=$"Rainbow Tab Reference", "ValueSignaling"=0, error in=w59) -> (error out=w60)
            call "Wait ms.gvi"(Error In=w60, Milliseconds to Wait=250) -> (Error Out=w17)
            w18 = w58
            w19 = default
            w20 = s3
            w21 = s4
            w23 = s6
            w24 = s7
            w25 = s8
          }
          frame "Stop App" {
            w61 = "Start App"  # SRM States
            call "FGV Current State.gvi"(Current State Instructions="Set Current Substate", Current Substate="Stopping Apps", Error In=w13) -> (Error Out=w17)
            w18 = w61
            w19 = TRUE
            w20 = s3
            w21 = s4
            w22 = s5
            w23 = s6
            w24 = s7
            w25 = s8
          }
        }
        call "Progress FGV.gvi"(FGV Instructions="Set State", Progress In=0, Error In=w17) -> (Error Out=w62)
        Logical Or(w12, w62, w19) -> w63
        next s1 = w62
        next s2 = w18
        next s3 = w20
        next s4 = w21
        next s5 = w22
        next s6 = w23
        next s7 = w24
        next s8 = w25
        stop if w63
      }
      w1 = s1
      w2 = s4
      w3 = s3
      w4 = s5
      w5 = s8
      w6 = s6
    }
  }
  $"Instruction Queue Out" <- w4
  $"SRM Rainbow Parameters" <- w6
  $"FulL IV data Cluster" <- w5
  $"Instuments Coms Info Out" <- w2
  $"Debugging Cluster Out" <- w3
  $"Error Out" <- w1
