vi "Light Calibration file handling.gvi"   [LabVIEW NXG 5.0.0]
inputs:
  "Error In": error
  "Default Data Saving Location": path
  "Modify File Operation": "Modify File Operation.gtype" = "Save TXT"
  "Light Power Calibration Data In": "Light Power Calibration Data.gtype"[]
  "Cell Naming Cluster": "Cell Naming Cluster.gtype"
outputs:
  "Error Out": error
  "Light Power Calibration Data Out": "Light Power Calibration Data.gtype"[]
  "Found Any File?": bool
  "Canceled Loading?": bool
  "Loaded Files": string[]
types:
  "Modify File Operation.gtype" = enum{"Save TXT", "Load TXT"}
  T1 = cluster{"Dividing Wavelength Array": f64[], "Measured Power Array": f64[]}
  "Rainbow Sweep Types.gtype" = enum{"Red Sweep Closing", "Red Sweep Opening", "Blue Sweep Closing", "Blue Sweep Opening"}
  "Light Power Calibration Data.gtype" = cluster{"Single Light Calibration": T1, "Rainbow Sweep Types": "Rainbow Sweep Types.gtype"}
  "Cell Naming Cluster.gtype" = cluster{"Cell Label": string, "Sample Prefix": string, "Author Initials": string, "Current Date": string, "Batch Name": string}
uses:
  Rainbow Measurement Setup::Side Functions::Messages And Prompts::Select path prompt.gvi
  Rainbow Measurement Setup::Side Functions::Path Manipulation::Filename Scan For Sweep.gvi
  Rainbow Measurement Setup::Main Functions::Modify TXT file::Modify Measurement TXT File.gvi
diagram:
  # This subVI Handles the Saving of all the Light Power Calibration Spectra Calibration Files. It can both save and load the files from a specified folder and to the user folder respectively
  case ($"Error In") {
    frame Error, Default {
      w1 = $"Error In"
      w2 = default
      w3 = $"Light Power Calibration Data In"
      w4 = default
      w5 = default
    }
    frame No Error {
      case ($"Modify File Operation") {
        frame "Load TXT" {
          w6 = "Please Select the folder with all the Light Power Calibration Files you want to Load. "
          w7 = "(All available Calibration  Files Will be Loaded Automatically)"
          call "Select path prompt.gvi"(Main Message=w6, Sub message=w7, Error In=$"Error In", Cancel Available?=TRUE) -> (New Path=w8, Cancelled?=w9, Error Out=w10)
          case (w9) {
            frame True {
              w3 = default
              w1 = w10
              w4 = TRUE
              w5 = default
              w2 = TRUE
            }
            frame False {
              List Folder(error in=w10, path=w8) -> (error out=w11, file names=w12, path out=w13)
              s1 = w11  # shift register
              s2 = 0  # shift register
              s3 = "Light Power Calibration Data.gtype"[] []  # shift register
              for {
                w14 = each element of w12
                Build Path(base path=w13, name or relative path=w14) -> (appended path=w16)
                Search And Replace String(error in (no error)=s1, input string=w14, search string="Power_Calibration") -> (error out=w17, number of replacements=w18)
                call "Filename Scan For Sweep.gvi"(FileName In=w14, Error In=w17) -> (Is File sweep type?=w19, Sweep Type=w20, Error Out=w21)
                Is Not Equal To 0(x=w18) -> w22
                Logical And(w22, w19) -> w23
                case (w23) {
                  frame False, Default {
                    w24 = s2
                    w25 = s3
                    w26 = w21
                    w27 = default
                  }
                  frame True {
                    Array Index(array=s3) -> (out0[s2]=w28)
                    call "Modify Measurement TXT File.gvi"(Filename to load/save=w16, Modify File Operation=$"Modify File Operation", Error In=w21, Measurement File Type="Light Calibration Power") -> (Loaded Data=w29, Error Out=w26)
                    Array Index(array=w29) -> (out0[_, 0]=w30, out1[_, 1]=w31)
                    Property Node(instance in=w28, "Single Light Calibration:Dividing Wavelength Array"=w30, "Single Light Calibration:Measured Power Array"=w31, "Rainbow Sweep Types"=w20) -> (instance out=w32)
                    Insert Into Array(inArray=s3, new=w32) -> w25
                    Increment(x=s2) -> w24
                    w27 = TRUE
                  }
                }
                append w27 to w15
                append w14 to w5 if w23
                next s1 = w26
                next s2 = w24
                next s3 = w25
              }
              Or Array Elements(Boolean array=w15) -> (logical OR=w2)
              w3 = s3
              w1 = s1
              w4 = default
            }
          }
        }
        frame "Save TXT", Default {
          s4 = $"Error In"  # shift register
          for {
            w33 = each element of $"Light Power Calibration Data In"
            Property Node(instance in=w33) -> ("Single Light Calibration"=w34, "Rainbow Sweep Types"=w35)
            Property Node(instance in=w34) -> ("Dividing Wavelength Array"=w36, "Measured Power Array"=w37)
            Build Array(w36, w37) -> w38
            Transpose 2D Array(2D array=w38) -> (transposed array=w39)
            call "Modify Measurement TXT File.gvi"(Rainbow Sweep Types=w35, Default Data Saving Location=$"Default Data Saving Location", Modify File Operation=$"Modify File Operation", Data To Save=w39, Error In=s4, Cell Naming Cluster=$"Cell Naming Cluster", Measurement File Type="Light Calibration Power") -> (Error Out=w40)
            next s4 = w40
          }
          w1 = s4
          w2 = default
          w3 = $"Light Power Calibration Data In"
          w4 = default
          w5 = default
        }
      }
    }
  }
  $"Found Any File?" <- w2
  $"Light Power Calibration Data Out" <- w3
  $"Loaded Files" <- w5
  $"Canceled Loading?" <- w4
  $"Error Out" <- w1
