vi "Light Power Calibration Load Prompt.gvi"   [LabVIEW NXG 5.0.0]
inputs:
  "Found Any File?": bool
  "Stand Alone": bool
  "Error In": error
  "Canceled Loading?": bool
  "Loaded Files": string[]
outputs:
  "Desired State": "Light Power Calibration States.gtype"
  "Error Out": error
types:
  "Light Power Calibration States.gtype" = enum{"Start App", "Detect Instruments", "Initialize Instruments", "Rainbow Sweep", "Close Coms", "Load Calibration", "Save Graphs", "Stop App"}
diagram:
  # This SubVI Prompts the user in case it does not find any calibration file and asks if it
  # wants to perform a new calibration. It also checks if the loading process got cancelled
  # and if it did it poompts the user accordingly. It also tells the user the files that have been loaded
  case ($"Error In") {
    frame Error, Default {
      w1 = $"Error In"
      w2 = "Stop App"
    }
    frame No Error {
      Logical And($"Found Any File?", not $"Canceled Loading?") -> w3
      case (w3) {
        frame False { }
        frame True {
          w4 = "Your Files have been succesfully\nloaded. They are the Following:\n\n"
          s1 = w4  # shift register
          for {
            w5 = each element of $"Loaded Files"
            Concatenate Strings(s1, w5, "\r\n") -> w6
            next s1 = w6
          }
          w7 = "\nRemember: This means you can only \nperform these types of sweeps!"
          Concatenate Strings(s1, w7) -> w8
          One Button Dialog(button name ("OK")="Okay Thanks :)", message=w8)
        }
      }
      case ($"Found Any File?") {
        frame False, Default {
          Select(s=$"Stand Alone", t="Detect Instruments", f="Initialize Instruments") -> w10
          w11 = "I could not find any Light Power calibration file\non the specified folder. \nDo you want to perform a new calibration?"
          Two Button Dialog(F button name ("Cancel")="Nah, I'm feeling lazy", T button name ("OK")="Okay, let's do it", message=w11) -> (T Button?=w12)
          Select(s=w12, t=w10, f="Stop App") -> w9
        }
        frame True {
          w9 = "Stop App"
        }
      }
      case ($"Canceled Loading?") {
        frame False {
          w2 = w9
        }
        frame True {
          Select(s=$"Canceled Loading?", t="Stop App", f=w9) -> w2
          w13 = "I Cannot load any file if you do \nnot specify a propper path ¯\\_(ツ)_/¯"
          One Button Dialog(button name ("OK")="Oops, Sorry", message=w13)
        }
      }
      w1 = $"Error In"
    }
  }
  $"Error Out" <- w1
  $"Desired State" <- w2
