vi "Light Power Calibration Subroutine.gvi"   [LabVIEW NXG 5.0.0]
inputs:
  "Error In": error
  "Instrument Coms Info In": "Instrument Coms Info.gtype"
  "Debugging Cluster In": "Debugging Cluster.gtype"
  "Default Data Saving Location": path
  "Stand Alone?": bool
  "Light Power Calibration Data In": "Light Power Calibration Data.gtype"[]
  "Cell Naming Cluster": "Cell Naming Cluster.gtype"
  "Rainbow Sweep Param Selector": "Rainbow Sweep Param Selector.gtype" = {0, 1100, 300, 1, 1, 0}
outputs:
  "Error Out": error
  "Instuments Coms Info Out": "Instrument Coms Info.gtype"
  "Debugging Cluster Out": "Debugging Cluster.gtype"
  "Light Power Calibration Data Out": "Light Power Calibration Data.gtype"[]
panel controls:
  "Light Calibration Operation": "Light Power Operation Control.gtype" = "Save Calibration"
types:
  "Raibow Sweep Selector.gtype" = enum{"Red Sweep", "Blue Sweep", "Full Sweep Red First", "Full Sweep Blue First"}
  T1 = enum{"Red Sweep Closing", "Red Sweep Opening", "Red Sweep Both Ways"}
  T2 = enum{"Blue Sweep Opening", "Blue Sweep Closing", "Blue Sweep Both Ways"}
  "Rainbow Sweep Type Selector.gtype" = cluster{"Red Sweep Mode": T1, "Blue Sweep Mode": T2}
  "Rainbow Sweep Param Selector.gtype" = cluster{"Raibow Sweep Selector": "Raibow Sweep Selector.gtype", "Max Wavelength (nm)": f64, "Min Wavelength (nm)": f64, "Wavelength Step (nm)": f64, "Rainbow Sweep Type Selector": "Rainbow Sweep Type Selector.gtype"}
  "Insturment Debugging Cluster.gtype" = cluster{"Keithley": bool, "Arduinos": bool, "Thorlabs Motors": bool, "Photodetector": bool, "Flame Spectr": bool}
  "Debugging Cluster.gtype" = cluster{"Debugging mode?": bool, "Initialize App": bool, "Insturment Debugging": "Insturment Debugging Cluster.gtype"}
  T3 = cluster{"Element 1": "VISA Instr", "Element 2": string}
  "Arduino Detection cluster control.gtype" = cluster{"XZ Stage Arduino Address": "VISA Instr", "XZ Stage Arduino Detected?": bool, "Multiplexer Arduino Detected?": bool, "Multiplexer Arduino Address": "VISA Instr", "Arduinos List": T3[], "XZ Stage Log": string, "Multiplexer Log": string}
  "Thorlabs Motors Serial Number In.gtype" = cluster{"Thorlabs Blue Motor": string, "Thorlabs Red Motor": string, "Blue Motor Homed?": bool, "Red Motor Homed?": bool}
  "Instrument Coms Info.gtype" = cluster{"Arduino Coms Info": "Arduino Detection cluster control.gtype", "Photodetector Names": string[], "Keythley Address": "VISA Instr", "Photodetector Detected?": bool, "Thorlabs Motors Detected?": bool, "Keithley Detected?": bool, "Thorlabs Motors Serial Number": "Thorlabs Motors Serial Number In.gtype", "Photodetector IVI session": "Ivi IviDefault", "Flame ID": string, "Flame Detected?": bool, "Flame Wrapper ID": u64}
  "Cell Naming Cluster.gtype" = cluster{"Cell Label": string, "Sample Prefix": string, "Author Initials": string, "Current Date": string, "Batch Name": string}
  T4 = cluster{"Dividing Wavelength Array": f64[], "Measured Power Array": f64[]}
  "Rainbow Sweep Types.gtype" = enum{"Red Sweep Closing", "Red Sweep Opening", "Blue Sweep Closing", "Blue Sweep Opening"}
  "Light Power Calibration Data.gtype" = cluster{"Single Light Calibration": T4, "Rainbow Sweep Types": "Rainbow Sweep Types.gtype"}
  "Light Power Operation Control.gtype" = enum{"Save Calibration", "Load Calibration", "New Calibration"}
uses:
  Rainbow Measurement Setup::Main Functions::Rainbow Measurement::Light Power Calibration::Light Power Operation FGV.gvi
  Rainbow Measurement Setup::Main Functions::Instruction Queue::Current State::FGV Current State.gvi
  Rainbow Measurement Setup::Side Functions::Global Abort::FGV Global Abort.gvi
  Rainbow Measurement Setup::Main Functions::Rainbow Measurement::Light Power Calibration::Light Calibration Start Calculator.gvi
  Rainbow Measurement Setup::Side Functions::Instrument Control::Thorlabs Motors::Dividing Wavelength Control::Dividing Wavelength Calibration Data FGV.gvi
  Rainbow Measurement Setup::Side Functions::Instrument Control::Debug Cluster Instrument Extractor.gvi
  Rainbow Measurement Setup::Main Functions::One Time Calibrations::Beam Power Density::Specific Detect Instruments Subroutine.gvi
  Rainbow Measurement Setup::Side Functions::Instrument Control::Thorlabs Motors::Movement::KCube Move to 0 or Home.gvi
  Rainbow Measurement Setup::Side Functions::Instrument Control::Arduino::XZ Stage Arduino::XZ Stage Initialize And Home.gvi
  Rainbow Measurement Setup::Side Functions::Instrument Control::Photodetector::Photodetector Initialize.gvi
  Rainbow Measurement Setup::Main Functions::Rainbow Measurement::Light Power Calibration::Light Power Calibration Sweep.gvi
  Rainbow Measurement Setup::Side Functions::Instrument Control::Photodetector::Photodetector Close Coms.gvi
  Rainbow Measurement Setup::Side Functions::Instrument Control::Arduino::XZ Stage Arduino::XZ Stage Close Coms.gvi
  Rainbow Measurement Setup::Side Functions::Instrument Control::Thorlabs Motors::Movement::KCube Motors Close.gvi
  Rainbow Measurement Setup::Main Functions::Rainbow Measurement::Light Power Calibration::File Handling::Light power Calibration Save Graphs Prompt.gvi
  Rainbow Measurement Setup::Main Functions::Rainbow Measurement::Light Power Calibration::File Handling::Light Calibration file handling.gvi
  Rainbow Measurement Setup::Main Functions::Rainbow Measurement::Light Power Calibration::File Handling::Light Power Calibration Load Prompt.gvi
  Rainbow Measurement Setup::Side Functions::Messages And Prompts::General Simple Prompt.gvi
  Rainbow Measurement Setup::Side Functions::Utilities::Progress Handling::Progress FGV.gvi
diagram:
  # This SubVI Measures the Light power for each motor position for each sweep type and outputs the data so that it can be plotted
  # on the main window for checking and for calibration purposes
  case ($"Error In") {
    frame Error, Default {
      w1 = $"Error In"
      w2 = default
      w3 = $"Instrument Coms Info In"
      w4 = $"Debugging Cluster In"
    }
    frame No Error {
      call "Light Power Operation FGV.gvi"(FGV Instructions="Read State", Error In=$"Error In") -> (Light Power Operation Out=w5, Error Out=w6)
      Select(s=$"Stand Alone?", t=$"Light Calibration Operation", f=w5) -> w7
      call "FGV Current State.gvi"(Current State Instructions="Set Current State and Substate", Current State="Light Power Calibration", Current Substate="", Error In=w6) -> (Error Out=w8)
      s1 = w8  # shift register
      s2 = "Start App"  # shift register
      s3 = $"Debugging Cluster In"  # shift register
      s4 = $"Instrument Coms Info In"  # shift register
      s5 = $"Light Power Calibration Data In"  # shift register
      while {
        call "FGV Global Abort.gvi"(Global Abort Instructions="Read Current State", Error In=s1) -> (Local Abort Out=w9, Global Abort Out=w10, Error Out=w11)
        Select(s=w9, t="Close Coms", f=s2) -> w12
        case (w12) {
          frame "Start App", Default {
            call "Light Calibration Start Calculator.gvi"(Operation Control=w7, Stand Alone?=$"Stand Alone?") -> (Output=w14)
            call "FGV Current State.gvi"(Current State Instructions="Set Current Substate", Current Substate="Starting Light Power Calibration", Error In=w11) -> (Error Out=w13)
            w15 = s3
            w16 = s4
            w17 = s5
            w18 = default
            w19 = 0
          }
          frame "Detect Instruments" {
            call "FGV Current State.gvi"(Current State Instructions="Set Current Substate", Current Substate="Detecting Instruments", Error In=w11) -> (Error Out=w20)
            call "Dividing Wavelength Calibration Data FGV.gvi"(General FGV Instructions="Set State", Error In=w20) -> (Error Out=w21)
            call "Debug Cluster Instrument Extractor.gvi"(Debugging Cluster In=s3, Error In=w21) -> (Debuging Cluster Out=w15, Instruments to Detect=w22, Error Out=w23)
            call "Specific Detect Instruments Subroutine.gvi"(Instrument Coms Info In=s4, Error In=w23, Instruments To Detect Array=w22) -> (Instrument Coms Info Out=w16, Error Out=w13)
            w14 = "Initialize Instruments"
            w17 = s5
            w18 = default
            w19 = 20
          }
          frame "Initialize Instruments" {
            call "FGV Current State.gvi"(Current State Instructions="Set Current Substate", Current Substate="Initializing Instruments", Error In=w11) -> (Error Out=w24)
            call "KCube Move to 0 or Home.gvi"(Instrument Coms Info In=s4, Debugging Cluster In=s3, Error In=w24) -> (Instrument Coms Info Out=w25, Debugging Cluster Out=w26, Error Out=w27)
            call "XZ Stage Initialize And Home.gvi"(Instrument Coms Info In=w25, Debugging Cluster In=w26, Error In=w27) -> (Instrument Coms Info Out=w28, Debugging Cluster Out=w29, Error Out=w30)
            call "Photodetector Initialize.gvi"(Instrument Coms Info In=w28, Debugging Cluster In=w29, Error In=w30) -> (Instrument Coms Info Out=w16, Debugging Cluster Out=w15, Error Out=w13)
            w14 = "Rainbow Sweep"
            w17 = s5
            w18 = default
            w19 = 40
          }
          frame "Rainbow Sweep" {
            call "FGV Current State.gvi"(Current State Instructions="Set Current Substate", Current Substate="Acquiring Spectra", Error In=w11) -> (Error Out=w31)
            call "Light Power Calibration Sweep.gvi"(Instrument Coms Info In=s4, Debugging Cluster In=s3, Rainbow Sweep Param Selector=$"Rainbow Sweep Param Selector", Error In=w31) -> (Instrument Coms Info Out=w16, Debugging Cluster Out=w15, Light Power Calibration Data=w17, Error Out=w13)
            w14 = "Close Coms"
            w18 = default
            w19 = 80
          }
          frame "Close Coms" {
            call "FGV Current State.gvi"(Current State Instructions="Set Current Substate", Current Substate="Closing Coms", Error In=w11) -> (Error Out=w32)
            call "Photodetector Close Coms.gvi"(Instrument Coms Info In=s4, Debugging Cluster In=s3, Error In=w32) -> (Instrument Coms Info Out=w33, Debugging Cluster Out=w15, Error Out=w34)
            call "XZ Stage Close Coms.gvi"(Instrument Coms Info In=w33, Error In=w34) -> (Instrument Coms Info Out=w35, Error Out=w36)
            call "KCube Motors Close.gvi"(Instrument Coms Info In=w35, Error In=w36) -> (Instrument Coms Info Out=w16, Error Out=w37)
            call "Light power Calibration Save Graphs Prompt.gvi"(Error In=w37) -> (Desired State=w38, Error Out=w13)
            Select(s=w9, t="Stop App", f=w38) -> w14
            w17 = s5
            w18 = default
            w19 = 90
          }
          frame "Load Calibration" {
            call "FGV Current State.gvi"(Current State Instructions="Set Current Substate", Current Substate="Loading Calibration", Error In=w11) -> (Error Out=w39)
            call "Light Calibration file handling.gvi"(Modify File Operation="Load TXT", Error In=w39) -> (Duplicate Calibration Files?=w40, Light Power Calibration Data Out=w17, Found Any File?=w41, Loaded Files=w42, Error Out=w43, Canceled Loading?=w44)
            call "Light Power Calibration Load Prompt.gvi"(Duplicate Calibration Files?=w40, Found Any File?=w41, Stand Alone=$"Stand Alone?", Loaded Files=w42, Error In=w43, Canceled Loading?=w44) -> (Desired State=w14, Error Out=w13)
            w15 = s3
            w16 = s4
            w18 = default
            w19 = 40
          }
          frame "Save Graphs" {
            call "FGV Current State.gvi"(Current State Instructions="Set Current Substate", Current Substate="Saving Graphs", Error In=w11) -> (Error Out=w45)
            call "Light Calibration file handling.gvi"(Default Data Saving Location=$"Default Data Saving Location", Light Power Calibration Data In=s5, Modify File Operation="Save TXT", Error In=w45, Cell Naming Cluster=$"Cell Naming Cluster") -> (Light Power Calibration Data Out=w17, Error Out=w46)
            w47 = "Your Calibration Files Have been saved\npropperly on your personal data folder."
            call "General Simple Prompt.gvi"(Prompt Message=w47, Okay Button Message="Perfect Thanks :)", Error In=w46, Prompt?=TRUE) -> (Error Out=w13)
            w14 = "Stop App"
            w15 = s3
            w16 = s4
            w18 = default
            w19 = 95
          }
          frame "Stop App" {
            call "FGV Current State.gvi"(Current State Instructions="Set Current Substate", Current Substate="Stopping Apps", Error In=w11) -> (Error Out=w13)
            w14 = "Start App"
            w15 = s3
            w16 = s4
            w17 = s5
            w18 = TRUE
            w19 = 100
          }
        }
        call "Progress FGV.gvi"(FGV Instructions="Set State", Progress In=w19, Error In=w13) -> (Error Out=w48)
        Logical Or(w10, w48, w18) -> w49
        next s1 = w48
        next s2 = w14
        next s3 = w15
        next s4 = w16
        next s5 = w17
        stop if w49
      }
      w1 = s1
      w2 = s5
      w3 = s4
      w4 = s3
    }
  }
  $"Light Power Calibration Data Out" <- w2
  $"Instuments Coms Info Out" <- w3
  $"Debugging Cluster Out" <- w4
  $"Error Out" <- w1
