vi "Light Power Calibration Sweep.gvi"   [LabVIEW NXG 5.0.0]
inputs:
  "Error In": error
  "Instrument Coms Info In": "Instrument Coms Info.gtype"
  "Debugging Cluster In": "Debugging Cluster.gtype"
  "Rainbow Sweep Param Selector": "Rainbow Sweep Param Selector.gtype" = {0, 1100, 300, 1, 1, 0}
outputs:
  "Error Out": error
  "Instrument Coms Info Out": "Instrument Coms Info.gtype"
  "Debugging Cluster Out": "Debugging Cluster.gtype"
  "Light Power Calibration Data": "Light Power Calibration Data.gtype"[]
panel indicators:
  "output array": "Light Power Calibration Data.gtype"[]
types:
  "Raibow Sweep Selector.gtype" = enum{"Red Sweep", "Blue Sweep", "Full Sweep Red First", "Full Sweep Blue First"}
  T1 = enum{"Red Sweep Closing", "Red Sweep Opening", "Red Sweep Both Ways"}
  T2 = enum{"Blue Sweep Opening", "Blue Sweep Closing", "Blue Sweep Both Ways"}
  "Rainbow Sweep Type Selector.gtype" = cluster{"Red Sweep Mode": T1, "Blue Sweep Mode": T2}
  "Rainbow Sweep Param Selector.gtype" = cluster{"Raibow Sweep Selector": "Raibow Sweep Selector.gtype", "Max Wavelength (nm)": f64, "Min Wavelength (nm)": f64, "Wavelength Step (nm)": f64, "Rainbow Sweep Type Selector": "Rainbow Sweep Type Selector.gtype"}
  "Insturment Debugging Cluster.gtype" = cluster{"Keithley": bool, "Arduinos": bool, "Thorlabs Motors": bool, "Photodetector": bool, "Flame Spectr": bool}
  "Debugging Cluster.gtype" = cluster{"Debugging mode?": bool, "Initialize App": bool, "Insturment Debugging": "Insturment Debugging Cluster.gtype"}
  T3 = cluster{"Element 1": "VISA Instr", "Element 2": string}
  "Arduino Detection cluster control.gtype" = cluster{"XZ Stage Arduino Address": "VISA Instr", "XZ Stage Arduino Detected?": bool, "Multiplexer Arduino Detected?": bool, "Multiplexer Arduino Address": "VISA Instr", "Arduinos List": T3[], "XZ Stage Log": string, "Multiplexer Log": string}
  "Thorlabs Motors Serial Number In.gtype" = cluster{"Thorlabs Blue Motor": string, "Thorlabs Red Motor": string, "Blue Motor Homed?": bool, "Red Motor Homed?": bool}
  "Instrument Coms Info.gtype" = cluster{"Arduino Coms Info": "Arduino Detection cluster control.gtype", "Photodetector Names": string[], "Keythley Address": "VISA Instr", "Photodetector Detected?": bool, "Thorlabs Motors Detected?": bool, "Keithley Detected?": bool, "Thorlabs Motors Serial Number": "Thorlabs Motors Serial Number In.gtype", "Photodetector IVI session": "Ivi IviDefault", "Flame ID": string, "Flame Detected?": bool, "Flame Wrapper ID": u64}
  T4 = cluster{"Dividing Wavelength Array": f64[], "Measured Power Array": f64[]}
  "Rainbow Sweep Types.gtype" = enum{"Red Sweep Closing", "Red Sweep Opening", "Blue Sweep Closing", "Blue Sweep Opening"}
  "Light Power Calibration Data.gtype" = cluster{"Single Light Calibration": T4, "Rainbow Sweep Types": "Rainbow Sweep Types.gtype"}
  "LPC Sweep Live Parameters.gtype" = cluster{"Light Power (W) ": f64, "Current Wavelength (nm)": f64, "Rainbow Sweep Types": "Rainbow Sweep Types.gtype"}
uses:
  Rainbow Measurement Setup::Side Functions::Messages And Prompts::FGV Cancel Prompts until Finished Routine.gvi
  Rainbow Measurement Setup::Side Functions::Rainbow Sweep::Rainbow Sweep Param Generator.gvi
  Rainbow Measurement Setup::Side Functions::Instrument Control::Thorlabs Motors::Dividing Wavelength Control::Dividing Wavelength Calibration Data FGV.gvi
  Rainbow Measurement Setup::Side Functions::Global Abort::FGV Global Abort.gvi
  Rainbow Measurement Setup::Side Functions::Instrument Control::Thorlabs Motors::Dividing Wavelength Control::KCube Dividing Wavelength Translator.gvi
  Rainbow Measurement Setup::Side Functions::Utilities::Wait ms.gvi
  Rainbow Measurement Setup::Side Functions::Instrument Control::Photodetector::Photodetector Measure Power.gvi
  Rainbow Measurement Setup::Side Functions::Graphing::Multiple Page Graph Adapter.gvi
  Rainbow Measurement Setup::Main Functions::Rainbow Measurement::Light Power Calibration::Light Calibration Live Parameters FGV.gvi
  Rainbow Measurement Setup::Side Functions::Utilities::Progress Handling::Progress General Calculator.gvi
  Rainbow Measurement Setup::Side Functions::Utilities::Progress Handling::Progress FGV.gvi
diagram:
  # This SubVI Performs a sweep moving the motors and measuring the power that reaches the detector and then it stores everything on an array so that it can be later saved.
  case ($"Error In") {
    frame Error, Default {
      w1 = $"Error In"
      w2 = default
      w3 = $"Instrument Coms Info In"
      w4 = $"Debugging Cluster In"
    }
    frame No Error {
      Property Node(instance in=$"Debugging Cluster In") -> ("Insturment Debugging:Photodetector"=w5, "Debugging mode?"=w6, instance out=w7)
      call "FGV Cancel Prompts until Finished Routine.gvi"(Error In=$"Error In", FGV Instructions="Reset State") -> (Error Out=w8)
      call "Rainbow Sweep Param Generator.gvi"(Rainbow Sweep Parameters=$"Rainbow Sweep Param Selector", Error In=w8) -> (Rainbow Sweep Parameters Array=w9, Error Out=w10)
      Array Size(array=w9) -> (size(s)=w11)
      Initialize Array(element="Light Power Calibration Data.gtype" {all zero or empty}, size=w11) -> w12
      call "Dividing Wavelength Calibration Data FGV.gvi"(Div Wavelength FGV Instructions="Read Loaded Data", Error In=w10) -> (Dividing Wavelength Calibration Data Out=w13, Error Out=w14)
      Logical And[output inverted](not w5, w6) -> w15
      Property Node(instance in=$"Rainbow Sweep Param Selector") -> ("Wavelength Step (nm)"=w16)
      Multiply(w16, 1000) -> w17
      Select(s=w15, t=w17, f=1) -> w18
      s1 = w14  # shift register
      s2 = $"Instrument Coms Info In"  # shift register
      s3 = w7  # shift register
      s4 = w12  # shift register
      s5 = 0  # shift register
      for (N -> w19) (iteration -> i1) {
        w20 = each element of w9
        Property Node(instance in=w20) -> ("Dividing Wavelength Array"=w21, "Rainbow Sweep Types"=w22)
        s6 = s2  # shift register
        s7 = s1  # shift register
        s8 = s3  # shift register
        s9 = s5  # shift register
        s10 = s4  # shift register
        for (N -> w23) {
          w24 = each element of w21
          Array Index(array=s10) -> (out0[i1]=w25)
          Property Node(instance in=w25) -> ("Single Light Calibration"=w26, instance out=w27)
          Property Node(instance in=w26) -> ("Dividing Wavelength Array"=w28, "Measured Power Array"=w29, instance out=w30)
          call "FGV Global Abort.gvi"(Global Abort Instructions="Read Current State", Error In=s7) -> (Local Abort Out=w31, Global Abort Out=w32, Error Out=w33)
          call "KCube Dividing Wavelength Translator.gvi"(Debugging Cluster=s8, Dividing Wavelength=w24, Instrument Coms Info In=s6, Dividing Wavelength Calibration Data In=w13, Error In=w33, Rainbow Sweep Types=w22) -> (Real Dividing Wavelength=w34, Instrument Coms Info Out=w35, Error Out=w36)
          Build Array(w28, w34) -> w37
          call "Wait ms.gvi"(Error In=w36, Milliseconds to Wait=w18) -> (Error Out=w38)
          call "Photodetector Measure Power.gvi"(Instrument Coms Info In=w35, Debugging Cluster In=s8, Error In=w38) -> (Instrument Coms Info Out=w39, Debugging Cluster Out=w40, Measured Power=w41, Error Out=w42)
          Build Array(w29, w41) -> w43
          Property Node(instance in=w30, "Dividing Wavelength Array"=w37, "Measured Power Array"=w43) -> (instance out=w44)
          Property Node(instance in=w27, "Single Light Calibration"=w44, "Rainbow Sweep Types"=w22) -> (instance out=w45)
          Replace Array Subset(inArray=s10, index=i1, new=w45) -> w46
          $"output array" <- w46
          Multiply(w23, w19) -> w47
          Property Node(instance in="LPC Sweep Live Parameters.gtype" {all zero or empty}, "Light Power (W) "=w41, "Current Wavelength (nm)"=w34, "Rainbow Sweep Types"=w22) -> (instance out=w48)
          call "Multiple Page Graph Adapter.gvi"(Full Data Array=w46, Error In=w42) -> (Output Bundled Data=w49, Output Graph Ready Data=w50, Error Out=w51)
          call "Light Calibration Live Parameters FGV.gvi"(FGV Instructions="Set State", Light Calibration Live Parameters In=w48, Output Graph Ready Data=w50, Error In=w51, Graph Bundled data=w49) -> (Error Out=w52)
          call "Progress General Calculator.gvi"(Starting Value=40, Ending Value=80, Number Of Steps=w47, Current Step=s9, Error In=w52) -> (Current Progress=w53, Error Out=w54)
          call "Progress FGV.gvi"(FGV Instructions="Set State", Progress In=w53, Error In=w54) -> (Error Out=w55)
          Increment(x=s9) -> w56
          Logical Or(w31, w32) -> w57
          next s6 = w39
          next s7 = w55
          next s8 = w40
          next s9 = w56
          next s10 = w46
          stop if w57
        }
        call "Multiple Page Graph Adapter.gvi"(Full Data Array=s10, Error In=s7) -> (Output Bundled Data=w58, Output Graph Ready Data=w59, Error Out=w60)
        call "Light Calibration Live Parameters FGV.gvi"(FGV Instructions="Set State", Light Calibration Live Parameters In=w48, Output Graph Ready Data=w59, Error In=w60, Graph Bundled data=w58) -> (Error Out=w61)
        next s1 = w61
        next s2 = s6
        next s3 = s8
        next s4 = s10
        next s5 = s9
        stop if w57
      }
      w1 = s1
      w2 = s4
      w3 = s2
      w4 = s3
    }
  }
  $"Light Power Calibration Data" <- w2
  $"Error Out" <- w1
  $"Instrument Coms Info Out" <- w3
  $"Debugging Cluster Out" <- w4
