vi "Multiple Page Graph Adapter.gvi"   [LabVIEW NXG 5.0.0]
inputs:
  "Error In": error
  "Input XY data Multi Page": f64[][][]
outputs:
  "Error Out": error
  "Output Multi Graph": cluster{"Element 1": f64[], "Element 2": f64[]}[]
diagram:
  # This SubVI Takes a 3 dimensional array as an input and outputs
  # graph multicurve plot data so that it can be easily represented.
  case ($"Error In") {
    frame Error, Default {
      w1 = $"Error In"
      w2 = default
    }
    frame No Error {
      for {
        w3 = each element of $"Input XY data Multi Page"
        Array Index(array=w3) -> (out0[_, 0]=w4, out1[_, 1]=w5)
        for {
          w6 = each element of w4
          w7 = each element of w5
          Is Not Equal To 0(x=w6) -> w10
          append w6 to w8 if w10
          append w7 to w9 if w10
        }
        Build Cluster(w8, w9) -> w11
        append w11 to w2
      }
      w1 = $"Error In"
    }
  }
  $"Error Out" <- w1
  $"Output Multi Graph" <- w2
