vi "Arduino Detector.gvi"   [LabVIEW NXG 5.0.0]
inputs:
  "Error In": error
outputs:
  "Error Out": error
  "Arduino Detection info Out": "Arduino Detection cluster control.gtype"
panel indicators:
  "found resources": string[]
types:
  T1 = cluster{"Element 1": "VISA Instr", "Element 2": string}
  "Arduino Detection cluster control.gtype" = cluster{"XZ Stage Arduino Address": "VISA Instr", "XZ Stage Arduino Detected?": bool, "Multiplexer Arduino Detected?": bool, "Multiplexer Arduino Address": "VISA Instr", "Arduinos List": T1[]}
uses:
  NI::VISA::Find Resource (Search Resources).gvi
  Rainbow Measurement Setup::Main Functions::Instruction Queue::Current State::FGV Current State.gvi
  NI::VISA::Open (Instr).gvi
  NI::VISA::Read (Instr, String).gvi
  NI::VISA::Close (Instr).gvi
  NI::G Core::Error::Clear Error Cluster.gvi
diagram:
  # This loop scans all the VISA found sources and queries them in search for the arduino VISA addresses.
  # Once it finds the desired arduino it outputs the address into the Predefined cluster and the program finishes.
  case ($"Error In") {
    frame Error, Default {
      w1 = $"Error In"
    }
    frame No Error {
      call "Find Resource (Search Resources).gvi"() -> (found resources=w2)
      $"found resources" <- w2
      call "FGV Current State.gvi"(Current State Instructions="Set Current Substate", Current Substate="Detecting Arduinos", Error In=$"Error In") -> (Error Out=w3)
      for {
        w4 = each element of w2
        Search And Replace String(error in (no error)=w3, input string=w4, search string="ASRL") -> (error out=w10, number of replacements=w11)
        Is Not Equal To 0(x=w11) -> w12
        case (w12) {
          frame False, Default {
            w13 = w10
            w14 = ""
            w15 = ""
          }
          frame True {
            call "Open (Instr).gvi"(resource name=w4, error in=w10, open timeout=300) -> (session out=w16, error out=w17)
            call "Read (Instr, String).gvi"(session in=w16, error in=w17, byte count=50) -> (session out=w15, error out=w18, read buffer=w14)
            call "Close (Instr).gvi"(session in=w15, error in=w18) -> (error out=w19)
            call "Clear Error Cluster.gvi"(error in=w19) -> (error out=w13)
          }
        }
        Search And Replace String(error in (no error)=w13, input string=w14, search string="Arduin") -> (error out=w20, number of replacements=w21)
        Search And Replace String(error in (no error)=w20, input string=w14, search string="XZ Stage") -> (error out=w22, number of replacements=w23)
        Is Not Equal To 0(x=w23) -> w24
        Search And Replace String(error in (no error)=w22, input string=w14, search string="Multiplex") -> (error out=w1, number of replacements=w25)
        Is Not Equal To 0(x=w25) -> w26
        Build Cluster(w15, w14) -> w27
        Is Not Equal To 0(x=w21) -> w28
        Logical And(w28, w12) -> w29
        append w27 to w5 if w29
        append w24 to w6
        append w26 to w7
        w8 = w15 if w24
        w9 = w15 if w26
      }
      Or Array Elements(Boolean array=w6) -> (logical OR=w30)
      Or Array Elements(Boolean array=w7) -> (logical OR=w31)
      w32 = "Arduino Detection cluster control.gtype" {all zero or empty}
      Property Node(instance in=w32, "XZ Stage Arduino Address"=w8, "XZ Stage Arduino Detected?"=w30, "Multiplexer Arduino Detected?"=w31, "Multiplexer Arduino Address"=w9, "Arduinos List"=w5) -> (instance out=w33)
      $"Arduino Detection info Out" <- w33
    }
  }
  $"Error Out" <- w1
