vi "Keithley Sweep Subroutine.gvi"   [LabVIEW NXG 5.0.0]
inputs:
  "Error In": error
  "Debugging Cluster In": "Debugging Cluster.gtype"
  "Instrument Coms Info In": "Instrument Coms Info.gtype"
  "SRM Specific Parameters In": "SRM Specific Parameters.gtype"
  "IV Single Measurement In": "IV Single Measurement.gtype"
outputs:
  "Error Out": error
  "Instrument Coms Info Out": "Instrument Coms Info.gtype"
  "Debugging Cluster Out": "Debugging Cluster.gtype"
  "IV Single Measurement Out": "IV Single Measurement.gtype"
types:
  T1 = cluster{"Element 1": "VISA Instr", "Element 2": string}
  "Arduino Detection cluster control.gtype" = cluster{"XZ Stage Arduino Address": "VISA Instr", "XZ Stage Arduino Detected?": bool, "Multiplexer Arduino Detected?": bool, "Multiplexer Arduino Address": "VISA Instr", "Arduinos List": T1[], "XZ Stage Log": string, "Multiplexer Log": string}
  "Thorlabs Motors Serial Number In.gtype" = cluster{"Thorlabs Blue Motor": string, "Thorlabs Red Motor": string, "Blue Motor Homed?": bool, "Red Motor Homed?": bool}
  "Instrument Coms Info.gtype" = cluster{"Arduino Coms Info": "Arduino Detection cluster control.gtype", "Photodetector Names": string[], "Keythley Address": "VISA Instr", "Photodetector Detected?": bool, "Thorlabs Motors Detected?": bool, "Keithley Detected?": bool, "Thorlabs Motors Serial Number": "Thorlabs Motors Serial Number In.gtype", "Photodetector IVI session": "Ivi IviDefault", "Flame ID": string, "Flame Detected?": bool, "Flame Wrapper ID": u64}
  "Insturment Debugging Cluster.gtype" = cluster{"Keithley": bool, "Arduinos": bool, "Thorlabs Motors": bool, "Photodetector": bool, "Flame Spectr": bool}
  "Debugging Cluster.gtype" = cluster{"Debugging mode?": bool, "Initialize App": bool, "Insturment Debugging": "Insturment Debugging Cluster.gtype"}
  "IV Single Measurement.gtype" = cluster{"Voltage": f64[], "Current": f64[], "Current Density": f64[], "Dividing Wavelength": f64, "Light Power": f64}
  "SRM Specific Parameters.gtype" = cluster{"Max (V)": f64, "Min (V)": f64, "V Points": u32, "Current Range (A)": f64, "Autorange": bool, "Sweep Dir": bool, "Current Averages": u32, "Max (A)": f64, "Integration Time": f64, "Cell Area (m^2)": f64}
uses:
  Rainbow Measurement Setup::Side Functions::Instrument Control::Keithley::Random IV Curve Generator.gvi
  Rainbow Measurement Setup::Main Functions::Instruction Queue::Current State::FGV Current State.gvi
  Labview_NXG_Keithley_SMU_2450_2460_2461::Configure::Clear Buffer.gvi
  Labview_NXG_Keithley_SMU_2450_2460_2461::Action Status::Enable Output.gvi
  Labview_NXG_Keithley_SMU_2450_2460_2461::Data::Low Level::Initiate.gvi
  Rainbow Measurement Setup::Side Functions::Instrument Control::Keithley::FGV Keithley timeout.gvi
  Labview_NXG_Keithley_SMU_2450_2460_2461::Data::Low Level::Wait for Operation Complete.gvi
  Labview_NXG_Keithley_SMU_2450_2460_2461::Data::Read (Multiple Points).gvi
  Rainbow Measurement Setup::Side Functions::Instrument Control::Keithley::Keithley Timeout Check.gvi
  NI::VISA::Write (Instr, String).gvi
diagram:
  # This SubVI Initializes the Keithley Comunication In case the debugging allows it to do so
  case ($"Error In") {
    frame Error, Default {
      w1 = $"Error In"
      w2 = $"Instrument Coms Info In"
      w3 = $"Debugging Cluster In"
      w4 = $"IV Single Measurement In"
    }
    frame No Error {
      Property Node(instance in=$"Debugging Cluster In") -> ("Debugging mode?"=w5, "Insturment Debugging:Keithley"=w6, instance out=w3)
      Logical And[output inverted](w5, not w6) -> w7
      case (w7) {
        frame False, Default {
          call "Random IV Curve Generator.gvi"(SRM Specific Parameters In=$"SRM Specific Parameters In", Intensity Constant=1, Light Intensity=-1.7, Error In=$"Error In") -> (Voltage=w8, Current=w9, Error Out=w1)
          Property Node(instance in=$"IV Single Measurement In", "Voltage"=w8, "Current"=w9) -> (instance out=w4)
          w2 = $"Instrument Coms Info In"
        }
        frame True {
          Property Node(instance in=$"SRM Specific Parameters In") -> ("V Points"=w10)
          Property Node(instance in=$"Instrument Coms Info In") -> ("Keythley Address"=w11, instance out=w12)
          call "FGV Current State.gvi"(Current State Instructions="Set Current Substate", Current Substate="Sweeping Keithley", Error In=$"Error In") -> (Error Out=w13)
          call "Clear Buffer.gvi"(VISA resource name=w11, error in (no error)=w13) -> (VISA resource name out=w14, error out=w15)
          call "Enable Output.gvi"(VISA resource name=w14, Enable Output (T: Enable)=TRUE, error in (no error)=w15) -> (VISA resource name out=w16, error out=w17)
          call "Initiate.gvi"(VISA resource name=w16, error in (no error)=w17) -> (VISA resource name out=w18, error out=w19)
          call "FGV Keithley timeout.gvi"(FGV Instructions="Read State", Error In=w19) -> (Timeout in ms Out=w20, Error Out=w21)
          call "Wait for Operation Complete.gvi"(VISA resource name=w18, Timeout (10000 ms)=w20, error in (no error)=w21) -> (VISA resource name out=w22, error out=w23)
          call "Read (Multiple Points).gvi"(VISA resource name=w22, Start Index (1)=1, End Index (1)=w10, error in (no error)=w23, Buffer Elements="SOUR, READ") -> (VISA resource name out=w24, Data out=w25, error out=w26)
          # Clears all event registers and Error Queue
          Spreadsheet String To Array(array type=f64[] [], delimiter=",", format string="%s", spreadsheet string=w25) -> (array=w27)
          Decimate Array(array=w27) -> (out0=w28, out1=w29)
          Property Node(instance in=$"IV Single Measurement In", "Voltage"=w28, "Current"=w29) -> (instance out=w4)
          call "Keithley Timeout Check.gvi"(Error In=w26) -> (Error Out=w30)
          call "Enable Output.gvi"(VISA resource name=w24, Enable Output (T: Enable)=FALSE, error in (no error)=w30) -> (VISA resource name out=w31, error out=w32)
          call "Write (Instr, String).gvi"(session in=w31, error in=w32, write buffer="*CLS;") -> (session out=w33, error out=w1)
          Property Node(instance in=w12, "Keythley Address"=w33) -> (instance out=w2)
        }
      }
    }
  }
  $"Debugging Cluster Out" <- w3
  $"IV Single Measurement Out" <- w4
  $"Instrument Coms Info Out" <- w2
  $"Error Out" <- w1
