vi "Random IV Curve Generator.gvi"   [LabVIEW NXG 5.0.0]
inputs:
  "Error In": error
  "Array Lenght": i32
outputs:
  "Error Out": error
  "Voltage": f64[]
  "Current": f64[]
uses:
  NI::G Core::Numeric::Random Number (Range) DBL.gvi
diagram:
  case ($"Error In") {
    frame Error, Default {
      w1 = $"Error In"
      w2 = f64[] []
      w3 = f64[] []
    }
    frame No Error {
      for (N = $"Array Lenght") (iteration -> i1) {
        call "Random Number (Range) DBL.gvi"(upper bound=-5, lower bound=5) -> (number=w4)
        Subtract(x=i1, y=50) -> w5
        To Double Precision Float(number=w5) -> w6
        append w6 to w2
        append w4 to w3
      }
      w1 = $"Error In"
    }
  }
  $"Error Out" <- w1
  $Current <- w3
  $Voltage <- w2
