vi "KCube Dividing Wavelength Translator.gvi"   [LabVIEW NXG 5.0.0]
inputs:
  "Error In": error
  "Dividing Wavelength": f64
  "Rainbow Sweep Types": "Rainbow Sweep Types.gtype" = "Red Sweep Closing"
  "Dividing Wavelength Calibration Data In": "Dividing Wavelength Calibration Data.gtype"
  "Instrument Coms Info In": "Instrument Coms Info.gtype"
outputs:
  "Error Out": error
  "KCube Coordinates": "KCube Coordinates.gtype"
  "Instrument Coms Info Out": "Instrument Coms Info.gtype"
types:
  "Rainbow Sweep Types.gtype" = enum{"Red Sweep Closing", "Red Sweep Opening", "Blue Sweep Closing", "Blue Sweep Opening"}
  "KCube Coordinates.gtype" = cluster{"Blue Motor Position to move to (mm)": f64, "Red Motor Position to move to (mm)": f64}
  "Dividing Wavelength Calibration Data.gtype" = cluster{"Dividing Wavelength (nm) Array": f64[], "Blue Motor Position (mm) Array": f64[], "Red Motor Position (mm) Array": f64[]}
  T1 = cluster{"Element 1": "VISA Instr", "Element 2": string}
  "Arduino Detection cluster control.gtype" = cluster{"XZ Stage Arduino Address": "VISA Instr", "XZ Stage Arduino Detected?": bool, "Multiplexer Arduino Detected?": bool, "Multiplexer Arduino Address": "VISA Instr", "Arduinos List": T1[], "XZ Stage Log": string, "Multiplexer Log": string}
  "Thorlabs Motors Serial Number In.gtype" = cluster{"Thorlabs Blue Motor": string, "Thorlabs Red Motor": string, "Blue Motor Homed?": bool, "Red Motor Homed?": bool}
  "Instrument Coms Info.gtype" = cluster{"Arduino Coms Info": "Arduino Detection cluster control.gtype", "Photodetector Names": string[], "Keythley Address": "VISA Instr", "Photodetector Detected?": bool, "Thorlabs Motors Detected?": bool, "Keithley Detected?": bool, "Thorlabs Motors Serial Number": "Thorlabs Motors Serial Number In.gtype", "Photodetector IVI session": "Ivi IviDefault"}
uses:
  Rainbow Measurement Setup::Side Functions::Utilities::Round Number.gvi
  NXG_KCube_DC_Servo_Control::Utilities::Move To Position.gvi
diagram:
  # This subVI takes the dividing wavelength calibration data and the dividing wavelength and calculates
  # the position of the guillotine motors so as to have that exact wavelength
  case ($"Error In") {
    frame Error, Default {
      w1 = $"Error In"
      w2 = default
      w3 = $"Instrument Coms Info In"
    }
    frame No Error {
      Property Node(instance in=$"Dividing Wavelength Calibration Data In") -> ("Dividing Wavelength (nm) Array"=w4, "Blue Motor Position (mm) Array"=w5, "Red Motor Position (mm) Array"=w6)
      call "Round Number.gvi"(Number To Round=$"Dividing Wavelength", Number Of Decimals=1) -> (Rounded Number=w7)
      Search 1D Array(1D array=w4, element=w7) -> (index of element=w8)
      Is Less Than 0(x=w8) -> w9
      case (w9) {
        frame False, Default { }
        frame True {
          w10 = """Dividing wavelength not in the calibration file
please extend either the range or the resolution
of the calibration file or contact Martí 
Problem in KCube Dividing Wavelength Translator)"""
          One Button Dialog(button name ("OK")="Okay I will", message=w10)
        }
      }
      case ($"Rainbow Sweep Types") {
        frame "Red Sweep Closing", Default {
          Array Index(array=w5) -> (out0[w8]=w11)
          Property Node(instance in="KCube Coordinates.gtype" {all zero or empty}, "Blue Motor Position to move to (mm)"=w11) -> (instance out=w2)
          Property Node(instance in=$"Instrument Coms Info In") -> ("Thorlabs Motors Serial Number:Thorlabs Blue Motor"=w12, instance out=w3)
          call "Move To Position.gvi"(Motor Serial Number In=w12, Position to move in mm=w11, Error In=$"Error In") -> (Error Out=w1)
        }
        frame "Red Sweep Opening" {
          Array Index(array=w5) -> (out0[w8]=w13)
          Property Node(instance in="KCube Coordinates.gtype" {all zero or empty}, "Blue Motor Position to move to (mm)"=w13) -> (instance out=w2)
          Property Node(instance in=$"Instrument Coms Info In") -> ("Thorlabs Motors Serial Number:Thorlabs Blue Motor"=w14, instance out=w3)
          call "Move To Position.gvi"(Motor Serial Number In=w14, Position to move in mm=w13, Error In=$"Error In") -> (Error Out=w1)
        }
        frame "Blue Sweep Closing" {
          Array Index(array=w6) -> (out0[w8]=w15)
          Property Node(instance in="KCube Coordinates.gtype" {all zero or empty}, "Red Motor Position to move to (mm)"=w15) -> (instance out=w2)
          Property Node(instance in=$"Instrument Coms Info In") -> ("Thorlabs Motors Serial Number:Thorlabs Red Motor"=w16, instance out=w3)
          call "Move To Position.gvi"(Motor Serial Number In=w16, Position to move in mm=w15, Error In=$"Error In") -> (Error Out=w1)
        }
        frame "Blue Sweep Opening" {
          Array Index(array=w6) -> (out0[w8]=w17)
          Property Node(instance in="KCube Coordinates.gtype" {all zero or empty}, "Red Motor Position to move to (mm)"=w17) -> (instance out=w2)
          Property Node(instance in=$"Instrument Coms Info In") -> ("Thorlabs Motors Serial Number:Thorlabs Red Motor"=w18, instance out=w3)
          call "Move To Position.gvi"(Motor Serial Number In=w18, Position to move in mm=w17, Error In=$"Error In") -> (Error Out=w1)
        }
      }
    }
  }
  $"Instrument Coms Info Out" <- w3
  $"KCube Coordinates" <- w2
  $"Error Out" <- w1
