vi "KCube Move to 0 or Home.gvi"   [LabVIEW NXG 5.0.0]
inputs:
  "Error In": error
  "Instrument Coms Info In": "Instrument Coms Info.gtype"
outputs:
  "Error Out": error
  "Instrument Coms Info Out": "Instrument Coms Info.gtype"
types:
  T1 = cluster{"Element 1": "VISA Instr", "Element 2": string}
  "Arduino Detection cluster control.gtype" = cluster{"XZ Stage Arduino Address": "VISA Instr", "XZ Stage Arduino Detected?": bool, "Multiplexer Arduino Detected?": bool, "Multiplexer Arduino Address": "VISA Instr", "Arduinos List": T1[], "XZ Stage Log": string, "Multiplexer Log": string}
  "Thorlabs Motors Serial Number In.gtype" = cluster{"Thorlabs Blue Motor": string, "Thorlabs Red Motor": string, "Blue Motor Homed?": bool, "Red Motor Homed?": bool}
  "Instrument Coms Info.gtype" = cluster{"Arduino Coms Info": "Arduino Detection cluster control.gtype", "Photodetector Names": string[], "Keythley Address": "VISA Instr", "Photodetector Detected?": bool, "Thorlabs Motors Detected?": bool, "Keithley Detected?": bool, "Thorlabs Motors Serial Number": "Thorlabs Motors Serial Number In.gtype", "Photodetector IVI session": "Ivi IviDefault"}
uses:
  Rainbow Measurement Setup::Side Functions::Instrument Control::Thorlabs Motors::Movement::KCube Motors Initialize.gvi
  Rainbow Measurement Setup::Side Functions::Instrument Control::Thorlabs Motors::Movement::KCube Motors Move to Position.gvi
  Rainbow Measurement Setup::Side Functions::Instrument Control::Thorlabs Motors::Movement::KCube Motors Home sequence.gvi
  Rainbow Measurement Setup::Side Functions::Instrument Control::Thorlabs Motors::Movement::KCube Motors Close.gvi
diagram:
  # This subVI moves the motors to 0 or homes them in case they are not homed yet
  # to reset the position of the guillotine
  case ($"Error In") {
    frame Error, Default {
      w1 = $"Error In"
      w2 = $"Instrument Coms Info In"
    }
    frame No Error {
      Property Node(instance in=$"Instrument Coms Info In") -> ("Thorlabs Motors Serial Number:Blue Motor Homed?"=w3, "Thorlabs Motors Serial Number:Red Motor Homed?"=w4, instance out=w5)
      call "KCube Motors Initialize.gvi"(Instrument Coms Info In=w5, Error In=$"Error In") -> (Instrument Coms Info Out=w6, Error Out=w7)
      Logical And(w3, w4) -> w8
      case (w8) {
        frame True {
          call "KCube Motors Move to Position.gvi"(Instrument Coms Info In=w6, Error In=w7) -> (Instrument Coms Info Out=w9, Error Out=w10)
        }
        frame False {
          call "KCube Motors Home sequence.gvi"(Instrument Coms Info In=w6, Error In=w7) -> (Instrument Coms Info Out=w9, Error Out=w10)
        }
      }
      call "KCube Motors Close.gvi"(Instrument Coms Info In=w9, Error In=w10) -> (Instrument Coms Info Out=w2, Error Out=w1)
    }
  }
  $"Instrument Coms Info Out" <- w2
  $"Error Out" <- w1
