vi "Path Check & Generation.gvi"   [LabVIEW NXG 5.0.0]
inputs:
  "Error In": error
  "Default Data Saving Location": path
  "Measurement File Type": "Measurement File Type.gtype" = "Single Cell Rainbow"
  "Cell Naming Cluster": "Cell Naming Cluster.gtype"
  "Filename to load/save": path
  "Rainbow Sweep Types": "Rainbow Sweep Types.gtype" = "Red Sweep Closing"
outputs:
  "Error Out": error
  "File path": path
  "Folder to save data": path
types:
  "Measurement File Type.gtype" = enum{"Single Cell Rainbow", "Multiple Cell Rainbow", "Light Calibration Power", "Light Calibration Spectral Density", "Light Calibration Power Density", "Light Calibration Dividing Wavelength Spectrum", "Dividing Wavelength To Motor Position"}
  "Cell Naming Cluster.gtype" = cluster{"Cell Label": string, "Sample Prefix": string, "Author Initials": string, "Current Date": string, "Batch Name": string}
  "Rainbow Sweep Types.gtype" = enum{"Red Sweep Closing", "Red Sweep Opening", "Blue Sweep Closing", "Blue Sweep Opening"}
uses:
  NI::G Core::File IO (General)::Check if File or Folder Exists.gvi
  Rainbow Measurement Setup::Side Functions::Messages And Prompts::Select path prompt.gvi
  Rainbow Measurement Setup::Side Functions::Path Manipulation::Create or Open Folder.gvi
  Rainbow Measurement Setup::Side Functions::Utilities::Cell Naming::txt Extension adder.gvi
  NI::G Core::File IO (General)::Create Directory Recursive.gvi
diagram:
  # This SubVI Generates the file paths and filenames for the different types of files that will be saved
  case ($"Error In") {
    frame Error, Default {
      w1 = $"Error In"
      w2 = default
      w3 = $"Default Data Saving Location"
    }
    frame No Error {
      case ($"Measurement File Type") {
        frame "Single Cell Rainbow", Default {
          Property Node(instance in=$"Cell Naming Cluster") -> ("Author Initials"=w4, "Current Date"=w5, "Batch Name"=w6, "Sample Prefix"=w7)
          Concatenate Strings("Device ", w6) -> w8
          call "Check if File or Folder Exists.gvi"(file or folder=$"Default Data Saving Location", error in=$"Error In") -> (file or folder exists?=w9, error out=w10)
          Is Empty String Or Path(string/path=$"Default Data Saving Location") -> w11
          Logical Or(w11, not w9) -> w12
          case (w12) {
            frame False {
              w3 = $"Default Data Saving Location"
              w13 = w10
            }
            frame True {
              w14 = "Please specify the path where you want to save all your measurements:"
              call "Select path prompt.gvi"(Main Message=w14, Sub message="Sub paths with your name, date and device will be created", Error In=w10) -> (New Path=w3, Error Out=w13)
            }
          }
          call "Create or Open Folder.gvi"(Folder Root Path=w3, Folder Name=w4, Error In=w13) -> (New Folder's Path=w15, Error Out=w16)
          call "Create or Open Folder.gvi"(Folder Root Path=w15, Folder Name=w5, Error In=w16) -> (New Folder's Path=w17, Error Out=w18)
          call "Create or Open Folder.gvi"(Folder Root Path=w17, Folder Name=w8, Error In=w18) -> (New Folder's Path=w19, Error Out=w20)
          call "Create or Open Folder.gvi"(Folder Root Path=w19, Folder Name="TXT files", Error In=w20) -> (New Folder's Path=w21, Error Out=w22)
          call "txt Extension adder.gvi"(Name without .txt=w7, Error In=w22) -> (Name with .txt=w23, Error Out=w1)
          Build Path(base path=w21, name or relative path=w23) -> (appended path=w2)
        }
        frame "Multiple Cell Rainbow" {
          Property Node(instance in=$"Cell Naming Cluster") -> ("Author Initials"=w24, "Current Date"=w25, "Batch Name"=w26, "Cell Label"=w27, "Sample Prefix"=w28)
          call "Check if File or Folder Exists.gvi"(file or folder=$"Default Data Saving Location", error in=$"Error In") -> (file or folder exists?=w29, error out=w30)
          Is Empty String Or Path(string/path=$"Default Data Saving Location") -> w31
          Logical Or(w31, not w29) -> w32
          case (w32) {
            frame False {
              w3 = $"Default Data Saving Location"
              w33 = w30
            }
            frame True {
              w34 = "Please specify the path where you want to save all your measurements:"
              call "Select path prompt.gvi"(Main Message=w34, Sub message="Sub paths with your name, date and device will be created", Error In=w30) -> (New Path=w3, Error Out=w33)
            }
          }
          call "Create or Open Folder.gvi"(Folder Root Path=w3, Folder Name=w24, Error In=w33) -> (New Folder's Path=w35, Error Out=w36)
          call "Create or Open Folder.gvi"(Folder Root Path=w35, Folder Name=w25, Error In=w36) -> (New Folder's Path=w37, Error Out=w38)
          Concatenate Strings("Device ", w26) -> w39
          call "Create or Open Folder.gvi"(Folder Root Path=w37, Folder Name=w39, Error In=w38) -> (New Folder's Path=w40, Error Out=w41)
          call "Create or Open Folder.gvi"(Folder Root Path=w40, Folder Name="TXT files", Error In=w41) -> (New Folder's Path=w42, Error Out=w43)
          Concatenate Strings(w28, w27) -> w44
          call "txt Extension adder.gvi"(Name without .txt=w44, Error In=w43) -> (Name with .txt=w45, Error Out=w1)
          Build Path(base path=w42, name or relative path=w45) -> (appended path=w2)
        }
        frame "Light Calibration Power" {
          Property Node(instance in=$"Cell Naming Cluster") -> ("Author Initials"=w46, "Current Date"=w47, "Batch Name"=w48, "Sample Prefix"=w49)
          call "Check if File or Folder Exists.gvi"(file or folder=$"Default Data Saving Location", error in=$"Error In") -> (file or folder exists?=w50, error out=w51)
          Is Empty String Or Path(string/path=$"Default Data Saving Location") -> w52
          Logical Or(w52, not w50) -> w53
          case (w53) {
            frame False {
              w3 = $"Default Data Saving Location"
              w54 = w51
            }
            frame True {
              w55 = "Please specify the path where you want to save all your measurements:"
              call "Select path prompt.gvi"(Main Message=w55, Sub message="Sub paths with your name, date and device will be created", Error In=w51) -> (New Path=w3, Error Out=w54)
            }
          }
          Format Into String(errIn=w54, $"Rainbow Sweep Types") -> (outString=w56, errOut=w57)
          call "Create or Open Folder.gvi"(Folder Root Path=w3, Folder Name=w46, Error In=w57) -> (New Folder's Path=w58, Error Out=w59)
          call "Create or Open Folder.gvi"(Folder Root Path=w58, Folder Name=w47, Error In=w59) -> (New Folder's Path=w60, Error Out=w61)
          Concatenate Strings("Device ", w48) -> w62
          call "Create or Open Folder.gvi"(Folder Root Path=w60, Folder Name=w62, Error In=w61) -> (New Folder's Path=w63, Error Out=w64)
          call "Create or Open Folder.gvi"(Folder Root Path=w63, Folder Name="TXT files", Error In=w64) -> (New Folder's Path=w65, Error Out=w66)
          Concatenate Strings(w49, "Power_Calibration_", w56) -> w67
          call "txt Extension adder.gvi"(Name without .txt=w67, Error In=w66) -> (Name with .txt=w68, Error Out=w1)
          Build Path(base path=w65, name or relative path=w68) -> (appended path=w2)
        }
        frame "Light Calibration Spectral Density" {
          Get Component Directory() -> (Path=w69)
          Strip Path(path=w69) -> (stripped path=w70)
          Build Path(base path=w70, name or relative path="Extra installers\\Calibration_Files") -> (appended path=w71)
          call "Check if File or Folder Exists.gvi"(file or folder=w71, error in=$"Error In") -> (file or folder exists?=w72, error out=w73)
          Is Empty String Or Path(string/path=w71) -> w74
          Logical Or(w74, not w72) -> w75
          case (w75) {
            frame False {
              w3 = w71
              w76 = w73
            }
            frame True {
              call "Create Directory Recursive.gvi"(folder=w71, error in=w73) -> (error out=w76)
              w3 = w71
            }
          }
          call "txt Extension adder.gvi"(Name without .txt="Spectral_Density_Calibration", Error In=w76) -> (Name with .txt=w77, Error Out=w1)
          Build Path(base path=w3, name or relative path=w77) -> (appended path=w2)
        }
        frame "Light Calibration Power Density" {
          Get Component Directory() -> (Path=w78)
          Strip Path(path=w78) -> (stripped path=w79)
          Build Path(base path=w79, name or relative path="Extra installers\\Calibration_Files") -> (appended path=w80)
          call "Check if File or Folder Exists.gvi"(file or folder=w80, error in=$"Error In") -> (file or folder exists?=w81, error out=w82)
          Is Empty String Or Path(string/path=w80) -> w83
          Logical Or(w83, not w81) -> w84
          case (w84) {
            frame False {
              w3 = w80
              w85 = w82
            }
            frame True {
              call "Create Directory Recursive.gvi"(folder=w80, error in=w82) -> (error out=w85)
              w3 = w80
            }
          }
          call "txt Extension adder.gvi"(Name without .txt="Power_Density_Calibration", Error In=w85) -> (Name with .txt=w86, Error Out=w1)
          Build Path(base path=w3, name or relative path=w86) -> (appended path=w2)
        }
        frame "Light Calibration Dividing Wavelength Spectrum" {
          Strip Path(path=$"Filename to load/save") -> (stripped path=w3)
          w1 = $"Error In"
          w2 = $"Filename to load/save"
        }
        frame "Dividing Wavelength To Motor Position" {
          Get Component Directory() -> (Path=w87)
          Strip Path(path=w87) -> (stripped path=w88)
          Build Path(base path=w88, name or relative path="Extra installers\\Calibration_Files\\Div_Wav_To_Motor_Pos") -> (appended path=w89)
          call "Check if File or Folder Exists.gvi"(file or folder=w89, error in=$"Error In") -> (file or folder exists?=w90, error out=w91)
          Is Empty String Or Path(string/path=w89) -> w92
          Logical Or(w92, not w90) -> w93
          case (w93) {
            frame False {
              w3 = w89
              w94 = w91
            }
            frame True {
              call "Create Directory Recursive.gvi"(folder=w89, error in=w91) -> (error out=w94)
              w3 = w89
            }
          }
          call "txt Extension adder.gvi"(Name without .txt="Dividing Wavelength To Motor Position Calibration File", Error In=w94) -> (Name with .txt=w95, Error Out=w1)
          Build Path(base path=w3, name or relative path=w95) -> (appended path=w2)
        }
      }
    }
  }
  $"Folder to save data" <- w3
  $"File path" <- w2
  $"Error Out" <- w1
