vi "Rainbow Sweep Param Generator.gvi"   [LabVIEW NXG 5.0.0]
inputs:
  "Error In": error
  "Rainbow Sweep Parameters": "Rainbow Sweep Param Selector.gtype"
outputs:
  "Error Out": error
  "Rainbow Sweep Parameters Array": "Rainbow Sweep Parameters.gtype"[]
types:
  "Raibow Sweep Selector.gtype" = enum{"Red Sweep", "Blue Sweep", "Full Sweep Red First", "Full Sweep Blue First"}
  "Rainbow Sweep Type Selector.gtype" = cluster{"Red Sweep Mode": enum{"Red Sweep Closing", "Red Sweep Opening"}, "Blue Sweep Mode": enum{"Blue Sweep Opening", "Blue Sweep Closing"}}
  "Rainbow Sweep Param Selector.gtype" = cluster{"Raibow Sweep Selector": "Raibow Sweep Selector.gtype", "Max Wavelength (nm)": f64, "Min Wavelength (nm)": f64, "Wavelength Step (nm)": f64, "Rainbow Sweep Types": "Rainbow Sweep Type Selector.gtype"}
  "Rainbow Sweep Types.gtype" = enum{"Red Sweep Closing", "Red Sweep Opening", "Blue Sweep Closing", "Blue Sweep Opening"}
  "Rainbow Sweep Parameters.gtype" = cluster{"Dividing Wavelength Array": f64[], "Rainbow Sweep Types": "Rainbow Sweep Types.gtype"}
uses:
  Rainbow Measurement Setup::Side Functions::Rainbow Sweep::Rainbow Sweep Type Extractor.gvi
diagram:
  # This SubVI Takes the desired wavelength range as well as the wavelength steps and the type of Rainbow Sweep that we want to perform and it outputs an array
  # that contains a cluster with the dividing wavelength array as well as the type of Rainbow sweep. It is an array because we might want to perform more than one sweep
  # per measurement.
  case ($"Error In") {
    frame Error, Default {
      w1 = $"Error In"
      w2 = default
    }
    frame No Error {
      Property Node(instance in=$"Rainbow Sweep Parameters") -> ("Max Wavelength (nm)"=w3, "Min Wavelength (nm)"=w4, "Wavelength Step (nm)"=w5)
      In Range And Coerce(lower limit=0.1, upper limit=9999999, x=w5) -> (coerced(x)=w6)
      Subtract(x=w3, y=w4) -> w7
      Absolute Value(x=w7) -> w8
      Divide(x=w8, y=w6) -> w9
      call "Rainbow Sweep Type Extractor.gvi"(Rainbow Sweep Parameters=$"Rainbow Sweep Parameters", Error In=$"Error In") -> (Rainbow Sweep Array=w10, Error Out=w11)
      To Signed 32 Bit Integer(number=w9) -> w12
      s1 = w11  # shift register
      for {
        w13 = each element of w10
        # w3: Max Wavelength
        # w4: Min Wavelength
        # w9: Ammount of Steps
        # w6: Wavelength Step
        case (w13) {
          frame "Red Sweep Opening", Default {
            for (N = w12) (iteration -> i1) {
              To Double Precision Float(number=i1) -> w16
              Multiply(w6, w16) -> w17
              Subtract(x=w3, y=w17) -> w18
              append w18 to w15
            }
            Property Node(instance in="Rainbow Sweep Parameters.gtype" {all zero or empty}, "Dividing Wavelength Array"=w15, "Rainbow Sweep Types"=w13) -> (instance out=w14)
          }
          frame "Red Sweep Closing" {
            for (N = w12) (iteration -> i2) {
              To Double Precision Float(number=i2) -> w20
              Multiply(w6, w20) -> w21
              Add(w4, w21) -> w22
              append w22 to w19
            }
            Property Node(instance in="Rainbow Sweep Parameters.gtype" {all zero or empty}, "Dividing Wavelength Array"=w19, "Rainbow Sweep Types"=w13) -> (instance out=w14)
          }
          frame "Blue Sweep Closing" {
            for (N = w12) (iteration -> i3) {
              To Double Precision Float(number=i3) -> w24
              Multiply(w6, w24) -> w25
              Subtract(x=w3, y=w25) -> w26
              append w26 to w23
            }
            Property Node(instance in="Rainbow Sweep Parameters.gtype" {all zero or empty}, "Dividing Wavelength Array"=w23, "Rainbow Sweep Types"=w13) -> (instance out=w14)
          }
          frame "Blue Sweep Opening" {
            for (N = w12) (iteration -> i4) {
              To Double Precision Float(number=i4) -> w28
              Multiply(w6, w28) -> w29
              Add(w4, w29) -> w30
              append w30 to w27
            }
            Property Node(instance in="Rainbow Sweep Parameters.gtype" {all zero or empty}, "Dividing Wavelength Array"=w27, "Rainbow Sweep Types"=w13) -> (instance out=w14)
          }
        }
        append w14 to w2
      }
      w1 = s1
    }
  }
  $"Error Out" <- w1
  $"Rainbow Sweep Parameters Array" <- w2
