vi "Read FGV Data Changed Idle Control Check.gvi"   [LabVIEW NXG 5.0.0]
inputs:
  "Error In": error
  "Misc Data Mega Cluster In": "Misc Data Mega Cluster.gtype"
outputs:
  "Error Out": error
  "Misc Data Mega Cluster Out": "Misc Data Mega Cluster.gtype"
  "Update IV Plot?": bool
  "Update Refined IV Plot?": bool
types:
  "Full Reference Cluster.gtype" = cluster{"Enum Reference Cluster": "Enum Control Reference Cluster.gtype", "Boolean Reference Cluster": "Boolean Control Reference Cluster.gtype", "Numeric Reference Cluster": "Numeric Control Reference Cluster.gtype", "Numeric Cluster Reference Cluster": "Numeric Cluster Reference Cluster.gtype", "Path Reference Cluster": "Path Reference Cluster.gtype", "Cluster Reference Cluster": "Cluster Reference Cluster.gtype", "XZ Stage Controls Reference Cluster": "XZ Stage Controls Reference Cluster.gtype"}
  "Cell Naming Cluster.gtype" = cluster{"Cell Label": string, "Sample Prefix": string, "Author Initials": string, "Current Date": string, "Batch Name": string}
  T1 = cluster{"X Coordinate (mm)": f64, "Z Coordinate (mm)": f64}
  T2 = cluster{"X Coordinate (mm)": f64, "Z Coordinate (mm)": f64, "Vertical Spacing (mm)": f64}
  "XZ All Position Cluster.gtype" = cluster{"Diffusor Coordinates": T1, "Photodetector Coordinates": T1, "Cell R.01 Coordinates": T2}
  T3 = cluster{"Thorlabs Motor Serial Number File Path": path, "Default Data Saving Location": path}
  "Misc Data Mega Cluster.gtype" = cluster{"Full Reference Cluster": "Full Reference Cluster.gtype", "Cell Naming Cluster": "Cell Naming Cluster.gtype", "All XZ Position Cluster": "XZ All Position Cluster.gtype", "All Paths": T3}
diagram:
  # This SubVI Checks if the controls have changed and if so it outputs a true flag so that the graphs update accordingly
  case ($"Error In") {
    frame Error, Default {
      w1 = $"Error In"
      w2 = $"Misc Data Mega Cluster In"
      w3 = default
      w4 = default
    }
    frame No Error {
      s1 = uninitialised  # shift register
      s2 = $"Error In"  # shift register
      s3 = $"Misc Data Mega Cluster In"  # shift register
      s4 = uninitialised  # shift register
      s5 = uninitialised  # shift register
      while {
        Property Node(instance in=s3) -> ("Full Reference Cluster:Enum Reference Cluster:Main Tab"=w5, "Full Reference Cluster:Enum Reference Cluster:Rainbow Measurement tab"=w6, "Full Reference Cluster:Cluster Reference Cluster:SRM Raw Plot Rainbow Sweep Selector"=w7, "Full Reference Cluster:Enum Reference Cluster:SRM Plot Parameter Selector Ref"=w8, "Full Reference Cluster:Cluster Reference Cluster:SRM Refined Plot Rainbow Sweep Types"=w9, instance out=w10)
        Property Node(instance in=w8, error in=s2) -> ("Value"=w11, error out=w12)
        Property Node(instance in=w9, error in=w12) -> ("Value"=w13, error out=w14)
        Property Node(instance in=w5, error in=w14) -> ("Value"=w15, error out=w16)
        Property Node(instance in=w6, error in=w16) -> ("Value"=w17, error out=w18)
        Property Node(instance in=w7, error in=w18) -> ("Value"=w19, error out=w20)
        Is Not Equal(x=s1, y=w19) -> w3
        Is Equal To 0(x=w15) -> w21
        Is Not Equal(x=w11, y=s5) -> w22
        Is Not Equal(x=w13, y=s4) -> w23
        Logical Or(w23, w22) -> w24
        Is Equal(x=w17, y=2) -> w25
        Logical And(w21, w25, w24) -> w4
        next s1 = w19
        next s2 = w20
        next s3 = w10
        next s4 = w13
        next s5 = w11
        stop if TRUE
      }
      w1 = s2
      w2 = s3
    }
  }
  $"Misc Data Mega Cluster Out" <- w2
  $"Update IV Plot?" <- w3
  $"Update Refined IV Plot?" <- w4
  $"Error Out" <- w1
