vi "Timeout Read FGV Data Subroutine.gvi"   [LabVIEW NXG 5.0.0]
inputs:
  "Misc Data Mega Cluster In": "Misc Data Mega Cluster.gtype"
  "Error In": error
outputs:
  "Misc Data Mega Cluster Out": "Misc Data Mega Cluster.gtype"
  "Error Out": error
types:
  "Full Reference Cluster.gtype" = cluster{"Enum Reference Cluster": "Enum Control Reference Cluster.gtype", "Boolean Reference Cluster": "Boolean Control Reference Cluster.gtype", "Numeric Reference Cluster": "Numeric Control Reference Cluster.gtype", "Numeric Cluster Reference Cluster": "Numeric Cluster Reference Cluster.gtype", "Path Reference Cluster": "Path Reference Cluster.gtype", "Cluster Reference Cluster": "Cluster Reference Cluster.gtype", "XZ Stage Controls Reference Cluster": "XZ Stage Controls Reference Cluster.gtype"}
  "Cell Naming Cluster.gtype" = cluster{"Cell Label": string, "Sample Prefix": string, "Author Initials": string, "Current Date": string, "Batch Name": string}
  T1 = cluster{"X Coordinate (mm)": f64, "Z Coordinate (mm)": f64}
  T2 = cluster{"X Coordinate (mm)": f64, "Z Coordinate (mm)": f64, "Vertical Spacing (mm)": f64}
  "XZ All Position Cluster.gtype" = cluster{"Diffusor Coordinates": T1, "Photodetector Coordinates": T1, "Cell R.01 Coordinates": T2}
  T3 = cluster{"Thorlabs Motor Serial Number File Path": path, "Default Data Saving Location": path}
  "Misc Data Mega Cluster.gtype" = cluster{"Full Reference Cluster": "Full Reference Cluster.gtype", "Cell Naming Cluster": "Cell Naming Cluster.gtype", "All XZ Position Cluster": "XZ All Position Cluster.gtype", "All Paths": T3}
uses:
  Rainbow Measurement Setup::Main Functions::Rainbow Measurement::Cell Single Rainbow Measurement::SRM Live Parameters::SRM Sweep Live Reference Clustering.gvi
  Rainbow Measurement Setup::Main Functions::Rainbow Measurement::Cell Single Rainbow Measurement::SRM Live Parameters::SRM Sweep Live Parameters FGV.gvi
  Rainbow Measurement Setup::Side Functions::Timeout Subroutines::Update Graphs Control Change.gvi
  Rainbow Measurement Setup::Side Functions::Timeout Subroutines::Read FGV Data Changed Idle Control Check.gvi
  Rainbow Measurement Setup::Main Functions::Rainbow Measurement::Light Power Calibration::Light Calibration Live Parameters FGV.gvi
diagram:
  # This SubVI Reads the data stored in the FGVs and outputs it so that
  # the graphs and everything can be populated, but it only does during
  # their respective subroutines so that it does not get overwhelmed
  case ($"Error In") {
    frame Error, Default {
      w1 = $"Error In"
      w2 = $"Misc Data Mega Cluster In"
    }
    frame No Error {
      s1 = uninitialised  # shift register
      s1.prev1 = uninitialised  # shift register
      s1.prev2 = uninitialised  # shift register
      s2 = $"Misc Data Mega Cluster In"  # shift register
      while {
        Property Node(instance in=s2) -> ("Full Reference Cluster"=w3, "Full Reference Cluster:Enum Reference Cluster:Current State Ref"=w4, instance out=w5)
        Property Node(instance in=w4, error in=$"Error In") -> ("Value"=w6, error out=w7)
        Is Equal(x=s1, y=s1.prev1) -> w8
        Is Equal(x=s1.prev1, y=s1.prev2) -> w9
        Logical And(w8, w9) -> w10
        Select(s=w10, t=w6, f=s1.prev2) -> w11
        case (w11) {
          frame "Rainbow Single Measurement" {
            call "SRM Sweep Live Reference Clustering.gvi"(Full Reference Cluster=w3) -> (SRM sweep live parameters FGV Cluster Out=w13)
            call "SRM Sweep Live Parameters FGV.gvi"(FGV Instructions="Read State", SRM sweep live parameters FGV Cluster In=w13, Error In=w7) -> (SRM Live Parameters=w14, IV Plot Out=w15, Error Out=w16)
            call "Update Graphs Control Change.gvi"(Misc Data Mega Cluster In=w5, Update Refined IV Plot?=TRUE, Error In=w16) -> (Misc Data Mega Cluster Out=w17, Error Out=w18)
            Property Node(instance in=w17) -> ("Full Reference Cluster:Cluster Reference Cluster:Sweep Live Parameters RSM"=w19, "Full Reference Cluster:Cluster Reference Cluster:IV Plot Out Ref"=w20, instance out=w12)
            Property Node(instance in=w19, "Value"=w14, error in=w18) -> (error out=w21)
            Property Node(instance in=w20, "Value"=w15, error in=w21) -> (error out=w1)
          }
          frame "Rainbow Multiple Measurement" {
            call "SRM Sweep Live Reference Clustering.gvi"(Full Reference Cluster=w3) -> (SRM sweep live parameters FGV Cluster Out=w22)
            call "SRM Sweep Live Parameters FGV.gvi"(FGV Instructions="Read State", SRM sweep live parameters FGV Cluster In=w22, Error In=w7) -> (SRM Live Parameters=w23, IV Plot Out=w24, Error Out=w25)
            call "Update Graphs Control Change.gvi"(Misc Data Mega Cluster In=w5, Update Refined IV Plot?=TRUE, Error In=w25) -> (Misc Data Mega Cluster Out=w26, Error Out=w27)
            Property Node(instance in=w26) -> ("Full Reference Cluster:Cluster Reference Cluster:Sweep Live Parameters RSM"=w28, "Full Reference Cluster:Cluster Reference Cluster:IV Plot Out Multiple Reference"=w29, instance out=w12)
            Property Node(instance in=w28, "Value"=w23, error in=w27) -> (error out=w30)
            Property Node(instance in=w29, "Value"=w24, error in=w30) -> (error out=w1)
          }
          frame "Idle", Default {
            call "Read FGV Data Changed Idle Control Check.gvi"(Misc Data Mega Cluster In=w5, Error In=w7) -> (Misc Data Mega Cluster Out=w31, Update IV Plot?=w32, Update Refined IV Plot?=w33, Error Out=w34)
            call "Update Graphs Control Change.gvi"(Misc Data Mega Cluster In=w31, Update Refined IV Plot?=w33, Error In=w34) -> (Misc Data Mega Cluster Out=w35, Error Out=w36)
            case (w32) {
              frame False, Default {
                w1 = w36
                w12 = w35
              }
              frame True {
                Property Node(instance in=w35) -> ("Full Reference Cluster:Cluster Reference Cluster:IV Plot Out Ref"=w37, instance out=w12)
                call "SRM Sweep Live Reference Clustering.gvi"(Full Reference Cluster=w3) -> (SRM sweep live parameters FGV Cluster Out=w38)
                call "SRM Sweep Live Parameters FGV.gvi"(FGV Instructions="Read State", SRM sweep live parameters FGV Cluster In=w38, Error In=w36) -> (IV Plot Out=w39, Error Out=w40)
                Property Node(instance in=w37, "Value"=w39, error in=w40) -> (error out=w1)
              }
            }
          }
          frame "Light Power Calibration" {
            Property Node(instance in=w5) -> ("Full Reference Cluster:Cluster Reference Cluster:Light Power Calibration"=w41, "Full Reference Cluster:Numeric Cluster Reference Cluster:Sweep Live Parameters LPC ref"=w42, instance out=w12)
            call "Light Calibration Live Parameters FGV.gvi"(Full Reference Cluster=w3, FGV Instructions="Read State", Error In=w7) -> (Light Calibration Parameters Out=w43, Light Power Calibration Graph Out=w44, Error Out=w45)
            Property Node(instance in=w41, "Value"=w44, error in=w45) -> (error out=w46)
            Property Node(instance in=w42, "Value"=w43, error in=w46) -> (error out=w1)
          }
        }
        next s1 = w6
        next s2 = w12
        stop if TRUE
      }
      w2 = s2
    }
  }
  $"Error Out" <- w1
  $"Misc Data Mega Cluster Out" <- w2
